# Grasshopper definition FuyaoFDA_imagecircle.gh (Grasshopper 1.0.7)
# plug-ins: Human UI, Dhictionary, Pufferfish, Kangaroo2 Components, LunchBox

panel = Panel("isRestoreUIStateFromData")

create_true_only_button = CreateTrueOnlyButton(ButtonName="修改迭代次数", ButtonStyle=1)
boolean = Boolean(False)
value_listener = ValueListener(Elements=create_true_only_button, SomeProperty=True)  # -> Values, Indices
create_text_box = CreateTextBox(Label="iteration times\t", DefaultText="100", UpdateButton=boolean, showLabel=True)
value_listener_2 = ValueListener(Elements=create_text_box, SomeProperty=True)  # -> Values, Indices
python = GhPythonScript(logoname="Fuyao_Logo.png")  # -> out, logopath
# ---------- python: Python ----------
__author__ = "DELL"
__version__ = "2022.07.08"

import rhinoscriptsyntax as rs
import Rhino
import os

path =Rhino.RhinoDoc.ActiveDoc.Path
dirpath = os.path.dirname(path)

logopath = dirpath + "\\" + logoname
# ---------- end python ----------
panel_2 = Panel("A_OuterEdge")
panel_3 = Panel("A_InnerEdge")
panel_4 = Panel("A_ReferEdge")
num = Number()
crv_cp = CurveClosestPoint()  # -> Point, Parameter, Distance
bool = Boolean(True)
iter = Slider(100, range=0..100)
int = Integer(10)
repeat = RepeatData(Data=int, Length=100)
panel_5 = Panel(value_listener_2.Values)
item = ListItem(List=repeat, Index=iter, Wrap=True)
ghpython_script = GhPythonScript(slider=iter, name="iter", val=panel_5, switch=value_listener.Values)
# ---------- ghpython_script: Python ----------
__author__ = "Administrator"
__version__ = "2022.07.06"

import rhinoscriptsyntax as rs
import Grasshopper as gh
import Rhino

grasshopper = Rhino.RhinoApp.GetPlugInObject("Grasshopper")
ghDoc = ghenv.Component.OnPingDocument()
ghObjects = ghDoc.Objects
for obj in ghObjects:
    if type(obj) is gh.Kernel.Special.GH_NumberSlider:
        objName = obj.NickName
        if objName == name and switch:
#            print(obj.ComponentGuid)
#            grasshopper.SetSliderValue(str(obj.ComponentGuid), int(val))
            obj.SetSliderValue(int(val))
            obj.Slider.Minimum = 0
            obj.Slider.Maximum = int(val)
iter_start = switch
# ---------- end ghpython_script ----------
attract = Attractor(AttractorDomain=Domain(0, 1))  # -> Values, Vectors, Distances

boolean_2 = Boolean(True)
create_radio_button = CreateRadioButton(RadioButtonName="孔状区域", RadioButtonGroup="TypeSelection", InitiallySelected=boolean_2)
create_radio_button_2 = CreateRadioButton(RadioButtonName="块状区域", RadioButtonGroup="TypeSelection", InitiallySelected=False)
create_radio_button_3 = CreateRadioButton(RadioButtonName="带状区域", RadioButtonGroup="TypeSelection", InitiallySelected=False)
create_true_only_button_2 = CreateTrueOnlyButton(ButtonName="开始填充", ButtonStyle=1)
number_slider = Slider(16, range=0..100)
note = Panel("删除按钮的功能还没写，这里只有UI")
number_slider_2 = Slider(14, range=0..100)
create_true_only_button_3 = CreateTrueOnlyButton(ButtonName="编辑填充", ButtonStyle=1)
create_true_only_button_4 = CreateTrueOnlyButton(ButtonName="删除填充", ButtonStyle=1)
adjust_element_appearance = AdjustElementAppearance(ElementsToAdjust=create_radio_button_3, FontSize=number_slider)
adjust_element_appearance_2 = AdjustElementAppearance(ElementsToAdjust=create_radio_button_2, FontSize=number_slider)
adjust_element_appearance_3 = AdjustElementAppearance(ElementsToAdjust=create_true_only_button_2, FontSize=Slider(14, range=0..100))
adjust_element_positioning = AdjustElementPositioning(
    ElementsToAdjust=create_true_only_button_2,
    Margin="0,10,0,0",
    AbsolutePositioning=False,
    Width=Slider(150, range=0..1000))
adjust_element_appearance_4 = AdjustElementAppearance(ElementsToAdjust=create_radio_button, FontSize=number_slider)
number_slider_3 = Slider(150, range=0..1000)
adjust_element_appearance_5 = AdjustElementAppearance(ElementsToAdjust=create_true_only_button_3, FontSize=number_slider_2)
create_label = CreateLabel(LabelText="编辑已填充区域", LabelSize=Slider(24, range=0..100), Justification=0)
value_listener_3 = ValueListener(Elements=create_radio_button, SomeProperty=True)  # -> Values, Indices
value_listener_4 = ValueListener(Elements=create_radio_button_2, SomeProperty=True)  # -> Values, Indices
value_listener_5 = ValueListener(Elements=create_true_only_button_2, SomeProperty=True)  # -> Values, Indices
value_listener_6 = ValueListener(Elements=create_radio_button_3, SomeProperty=True)  # -> Values, Indices
adjust_element_appearance_6 = AdjustElementAppearance(ElementsToAdjust=create_true_only_button_4, FontSize=number_slider_2)
boolean_3 = Boolean(True)
value_listener_7 = ValueListener(Elements=create_true_only_button_3, SomeProperty=True)  # -> Values, Indices
adjust_element_positioning_2 = AdjustElementPositioning(ElementsToAdjust=create_true_only_button_3, AbsolutePositioning=False, Width=number_slider_3)
ghpython_script_2 = GhPythonScript(okay=value_listener_5.Values, key=panel, mainWindowKey="mainWindowState")  # -> out, a, NullTrigger
# ---------- ghpython_script_2: Python ----------
__author__ = "USER"
__version__ = "2022.05.22"

import rhinoscriptsyntax as rs
import scriptcontext as sc

if not sc.sticky.has_key(key):
    sc.sticky[key] = {}
    
if okay:
    sc.sticky[key]["readInnerEdgeFromArchive"] = False
    sc.sticky[key]["readOuterEdgeFromArchive"] = False
    sc.sticky[key]["readReferEdgeFromArchive"] = False
    
    sc.sticky[key]["readRadiusFromArchive"] = False
    sc.sticky[key]["readHspaceFromArchive"] = False
    sc.sticky[key]["readVspaceFromArchive"] = False
    sc.sticky[key]["readHorizontalFromArchive"] = False
    sc.sticky[key]["readVerticalFromArchive"] = False
    sc.sticky[key]["readInnerRadiusFromArchive"] = False
    
    sc.sticky[mainWindowKey]["newArea"] = True
    sc.sticky[mainWindowKey]["editArea"] = False
# ---------- end ghpython_script_2 ----------
ghpython_script_3 = GhPythonScript(key="mainWindowState", isHole=value_listener_3.Values, isBlock=value_listener_4.Values, isBand=value_listener_6.Values)  # -> out
# ---------- ghpython_script_3: Python ----------
__author__ = "USER"
__version__ = "2022.05.22"

import scriptcontext as sc

sc.sticky[key] = {}
sc.sticky[key]["isHole"] = isHole
sc.sticky[key]["isBlock"] = isBlock
sc.sticky[key]["isBand"] = isBand
# ---------- end ghpython_script_3 ----------
ghpython_script_4 = GhPythonScript(okay=value_listener_5.Values, mainWindowKey="mainWindowState", holeWindowKey="holeAreaWindowState")  # -> out, isHoleWindow, isBlockWindow, isBandWindow
# ---------- ghpython_script_4: Python ----------
__author__ = "USER"
__version__ = "2022.05.22"

import scriptcontext as sc

def createGlobalDict(key):
    if not sc.sticky.has_key(key):
        sc.sticky[key] = {}

if okay:
    
    createGlobalDict(mainWindowKey)
    
    isHoleWindow = sc.sticky[mainWindowKey]["isHole"]
    isBlockWindow = sc.sticky[mainWindowKey]["isBlock"]
    isBandWindow = sc.sticky[mainWindowKey]["isBand"]
    
    if isHoleWindow:
        if sc.sticky.has_key("metadata"):
            sc.sticky[holeWindowKey]["holeAreaIndex"] = sc.sticky["metadata"][0] + 1
        else:
            sc.sticky[holeWindowKey]["holeAreaIndex"] = 1
# ---------- end ghpython_script_4 ----------
adjust_element_positioning_3 = AdjustElementPositioning(ElementsToAdjust=create_true_only_button_4, AbsolutePositioning=False, Width=number_slider_3)
number = Number(1)
create_label_2 = CreateLabel(LabelText="填充类型", LabelSize=Slider(24, range=0..100), Justification=0)
launch_window = LaunchWindow(
    Show=Toggle(True),
    Name="TOOL CONSOLE",
    Width=Slider(480, range=0..1000),
    Height=Slider(600, range=0..1000),
    FontFamily="Microsoft Yahei",
    ChildStatus=0,
    EnableHorizScroll=False)
ghpython_script_5 = GhPythonScript(okay=value_listener_7.Values, key=panel, mainWindowKey="mainWindowState", holeWindowKey="holeAreaWindowState")  # -> out, show
# ---------- ghpython_script_5: Python ----------
__author__ = "USER"
__version__ = "2022.05.22"

import rhinoscriptsyntax as rs

import scriptcontext as sc

if not sc.sticky.has_key(key):
    sc.sticky[key] = {}
    
if okay:
    sc.sticky[key]["readInnerEdgeFromArchive"] = True
    sc.sticky[key]["readOuterEdgeFromArchive"] = True
    sc.sticky[key]["readReferEdgeFromArchive"] = True
    
    sc.sticky[key]["readRadiusFromArchive"] = True
    sc.sticky[key]["readHspaceFromArchive"] = True
    sc.sticky[key]["readVspaceFromArchive"] = True
    sc.sticky[key]["readHorizontalFromArchive"] = True
    sc.sticky[key]["readVerticalFromArchive"] = True
    sc.sticky[key]["readInnerRadiusFromArchive"] = True
    
    sc.sticky[holeWindowKey]["holeAreaIndex"] = sc.sticky[mainWindowKey]["holeAreaIndexCandidate"]
    
    sc.sticky[mainWindowKey]["newArea"] = False
    sc.sticky[mainWindowKey]["editArea"] = True
    
    show = True
# ---------- end ghpython_script_5 ----------
ghpython_script_6 = GhPythonScript(okay=value_listener_7.Values, key="mainWindowState")  # -> out, holeAreaIndex
# ---------- ghpython_script_6: Python ----------
__author__ = "USER"
__version__ = "2022.05.22"

import rhinoscriptsyntax as rs
import scriptcontext as sc

print(okay)
if okay:
    holeAreaIndex = sc.sticky[key]["holeAreaIndexCandidate"]
print(holeAreaIndex)
# ---------- end ghpython_script_6 ----------
set_window_properties = SetWindowProperties(Window=launch_window, Theme=number, ShowTitleBar=True, ScaleFactor=1)
占位 = Panel("")
merge = Merge(Data1=create_true_only_button_3, Data2=create_true_only_button_4)
create_label_3 = CreateLabel(LabelText=占位, LabelSize=12, Justification=0)
merge_2 = Merge(
    Data1=create_label_2,
    Data2=create_radio_button,
    Data3=create_radio_button_2,
    Data4=create_radio_button_3,
    Data5=create_true_only_button_2)
create_stack = CreateStack(UIElements=merge, Horizontal=True)
create_label_4 = CreateLabel(LabelText="汽车玻璃印花填充工具", LabelSize=Slider(36, range=0..100), Justification="1")
boolean_4 = Boolean(False)
create_stack_2 = CreateStack(UIElements=merge_2, Horizontal=boolean_4)
adjust_element_positioning_4 = AdjustElementPositioning(ElementsToAdjust=create_stack, AbsolutePositioning=False, HorizontalAlignment=Slider(1, range=0..1))
create_border = CreateBorder(UIElement=create_stack_2, BorderThickness=Slider(0, range=0..100), BorderColor=RGB(0, 0, 0), CornerRadius=0)
boolean_5 = Boolean(False)

python_2 = GhPythonScript(logoname="Fuyao_Logo.png")  # -> out, logopath; same code as python

create_image = CreateImage(ImageSource=python_2.logopath, ImageWidth=Slider(100, range=0..1000), ImageHeight=Slider(22, range=0..100))
adjust_element_positioning_5 = AdjustElementPositioning(ElementsToAdjust=create_image, Margin="0,35,0,0", AbsolutePositioning=False, HorizontalAlignment=Slider(2, range=0..10))

ghpython_script_7 = GhPythonScript(show=ghpython_script_4.isHoleWindow, show2=ghpython_script_5.show)  # -> out, a
# ---------- ghpython_script_7: Python ----------
__author__ = "USER"
__version__ = "2022.05.22"

import rhinoscriptsyntax as rs
import scriptcontext as sc
if show is None and show2 is None:
    a = False
else:
    a = show
# ---------- end ghpython_script_7 ----------
launch_window_2 = LaunchWindow(
    Show=ghpython_script_7.a,
    Name="TOOL CONSOLE",
    Width=Slider(680, range=0..1000),
    Height=Slider(620, range=0..1000),
    FontFamily="Microsoft Yahei",
    ChildStatus=0,
    EnableHorizScroll=False)
number_2 = Number(1)
set_window_properties_2 = SetWindowProperties(Window=launch_window_2, Theme=number_2, ShowTitleBar=True, ScaleFactor=1)
boolean_6 = Boolean(False)
boolean_7 = Boolean(False)
boolean_8 = Boolean(False)
boolean_9 = Boolean(False)
boolean_10 = Boolean(False)
boolean_11 = Boolean(False)
create_rhino_pick_button = CreateRhinoPickButton(
    ButtonName="选择内边界曲线",
    Prompt="Please select geometry...",
    AllowMultiple=boolean_6,
    AllowNone=boolean_7,
    Type="2",
    ButtonStyle=1)
create_rhino_pick_button_2 = CreateRhinoPickButton(
    ButtonName="选择参考轮廓线",
    Prompt="Please select geometry...",
    AllowMultiple=boolean_9,
    AllowNone=boolean_10,
    Type="2",
    ButtonStyle=1)
create_rhino_pick_button_3 = CreateRhinoPickButton(
    ButtonName="选择外边界曲线",
    Prompt="Please select geometry...",
    AllowMultiple=boolean_11,
    AllowNone=boolean_8,
    Type="2",
    ButtonStyle=1)
ghpython_script_8 = GhPythonScript(
    mainWindowKey="mainWindowState",
    key=panel,
    value="0.5",
    archiveID=ghpython_script_6.holeAreaIndex,
    NullTrigger=ghpython_script_2.NullTrigger,
    holeSubKey="hole",
    bandSubKey="band")  # -> out, a
# ---------- ghpython_script_8: Python ----------
__author__ = "jinxinqi"
__version__ = "2022.05.06"

import rhinoscriptsyntax as rs
import scriptcontext as sc
import ghpythonlib.components as ghcomp
import Rhino
import System
import scriptcontext as sc

readFromArchive = sc.sticky[key]["readInnerRadiusFromArchive"]

# NullTrigger不可省略，否则的话，万一之前编辑过某个区域、使得全局变量里存储的值不为None，那么点击"开始填充"后全局变量里存储的值也不会自动清空（即变成None）
# "编辑填充"也需要一个trigger，这里用archiveID相当于同时也是一个trigger
a = None
try:
    if not readFromArchive:
        a = value
        print("new value used")
    else:
        if sc.sticky[mainWindowKey]["editHole"]:
            subkey = holeSubKey
        else:
            subkey = bandSubKey
        a = sc.sticky["data"][subkey][int(archiveID)-1]["innerRadius"]
        print("archive used")
except:
    pass
    
sc.sticky[key]["readInnerRadiusFromArchive"] = False
# ---------- end ghpython_script_8 ----------
ghpython_script_9 = GhPythonScript(
    mainWindowKey="mainWindowState",
    key=panel,
    value="2.2",
    archiveID=ghpython_script_6.holeAreaIndex,
    NullTrigger=ghpython_script_2.NullTrigger,
    holeSubKey="hole",
    bandSubKey="band")  # -> out, a
# ---------- ghpython_script_9: Python ----------
__author__ = "jinxinqi"
__version__ = "2022.05.06"

import rhinoscriptsyntax as rs
import scriptcontext as sc
import ghpythonlib.components as ghcomp
import Rhino
import System
import scriptcontext as sc

readFromArchive = sc.sticky[key]["readHorizontalFromArchive"]

# NullTrigger不可省略，否则的话，万一之前编辑过某个区域、使得全局变量里存储的值不为None，那么点击"开始填充"后全局变量里存储的值也不会自动清空（即变成None）
# "编辑填充"也需要一个trigger，这里用archiveID相当于同时也是一个trigger
a = None
try:
    if not readFromArchive:
        a = value
        print("new value used")
    else:
        if sc.sticky[mainWindowKey]["editHole"]:
            subkey = holeSubKey
        else:
            subkey = bandSubKey
        a = sc.sticky["data"][subkey][int(archiveID)-1]["horizontal"]
        print("archive used")
except:
    pass
    
sc.sticky[key]["readHorizontalFromArchive"] = False
# ---------- end ghpython_script_9 ----------
ghpython_script_10 = GhPythonScript(
    mainWindowKey="mainWindowState",
    key=panel,
    value="1.7",
    archiveID=ghpython_script_6.holeAreaIndex,
    NullTrigger=ghpython_script_2.NullTrigger,
    holeSubKey="hole",
    bandSubKey="band")  # -> out, a
# ---------- ghpython_script_10: Python ----------
__author__ = "jinxinqi"
__version__ = "2022.05.06"

import rhinoscriptsyntax as rs
import scriptcontext as sc
import ghpythonlib.components as ghcomp
import Rhino
import System
import scriptcontext as sc

readFromArchive = sc.sticky[key]["readVerticalFromArchive"]

# NullTrigger不可省略，否则的话，万一之前编辑过某个区域、使得全局变量里存储的值不为None，那么点击"开始填充"后全局变量里存储的值也不会自动清空（即变成None）
# "编辑填充"也需要一个trigger，这里用archiveID相当于同时也是一个trigger
a = None
try:
    if not readFromArchive:
        a = value
        print("new value used")
    else:
        if sc.sticky[mainWindowKey]["editHole"]:
            subkey = holeSubKey
        else:
            subkey = bandSubKey
        a = sc.sticky["data"][subkey][int(archiveID)-1]["vertical"]
        print("archive used")
except:
    pass
    
sc.sticky[key]["readVerticalFromArchive"] = False
# ---------- end ghpython_script_10 ----------
ghpython_script_11 = GhPythonScript(
    mainWindowKey="mainWindowState",
    key=panel,
    value="1.4 1.7",
    archiveID=ghpython_script_6.holeAreaIndex,
    NullTrigger=ghpython_script_2.NullTrigger,
    holeSubKey="hole",
    bandSubKey="band")  # -> out, a
# ---------- ghpython_script_11: Python ----------
__author__ = "jinxinqi"
__version__ = "2022.05.06"

import rhinoscriptsyntax as rs
import scriptcontext as sc
import ghpythonlib.components as ghcomp
import Rhino
import System
import scriptcontext as sc

readFromArchive = sc.sticky[key]["readVspaceFromArchive"]

# NullTrigger不可省略，否则的话，万一之前编辑过某个区域、使得全局变量里存储的值不为None，那么点击"开始填充"后全局变量里存储的值也不会自动清空（即变成None）
# "编辑填充"也需要一个trigger，这里用archiveID相当于同时也是一个trigger
a = None
try:
    if not readFromArchive:
        a = value
        print("new value used")
    else:
        if sc.sticky[mainWindowKey]["editHole"]:
            subkey = holeSubKey
        else:
            subkey = bandSubKey
        a = sc.sticky["data"][subkey][int(archiveID)-1]["vspace"]
        print("archive used")
except:
    pass
    
sc.sticky[key]["readVspaceFromArchive"] = False
# ---------- end ghpython_script_11 ----------
ghpython_script_12 = GhPythonScript(
    mainWindowKey="mainWindowState",
    key=panel,
    value="2.2",
    archiveID=ghpython_script_6.holeAreaIndex,
    NullTrigger=ghpython_script_2.NullTrigger,
    holeSubKey="hole",
    bandSubKey="band")  # -> out, a
# ---------- ghpython_script_12: Python ----------
__author__ = "jinxinqi"
__version__ = "2022.05.06"

import rhinoscriptsyntax as rs
import scriptcontext as sc
import ghpythonlib.components as ghcomp
import Rhino
import System
import scriptcontext as sc

readFromArchive = sc.sticky[key]["readHspaceFromArchive"]

# NullTrigger不可省略，否则的话，万一之前编辑过某个区域、使得全局变量里存储的值不为None，那么点击"开始填充"后全局变量里存储的值也不会自动清空（即变成None）
# "编辑填充"也需要一个trigger，这里用archiveID相当于同时也是一个trigger
a = None
try:
    if not readFromArchive:
        a = value
        print("new value used")
    else:
        if sc.sticky[mainWindowKey]["editHole"]:
            subkey = holeSubKey
        else:
            subkey = bandSubKey
        a = sc.sticky["data"][subkey][int(archiveID)-1]["hspace"]
        print("archive used")
except:
    pass
    
sc.sticky[key]["readHspaceFromArchive"] = False
# ---------- end ghpython_script_12 ----------
ghpython_script_13 = GhPythonScript(
    mainWindowKey="mainWindowState",
    key=panel,
    value="0.425 0.6 0.85",
    archiveID=ghpython_script_6.holeAreaIndex,
    NullTrigger=ghpython_script_2.NullTrigger,
    holeSubKey="hole",
    bandSubKey="band")  # -> out, a
# ---------- ghpython_script_13: Python ----------
__author__ = "jinxinqi"
__version__ = "2022.05.06"

import rhinoscriptsyntax as rs
import scriptcontext as sc
import ghpythonlib.components as ghcomp
import Rhino
import System
import scriptcontext as sc

readFromArchive = sc.sticky[key]["readRadiusFromArchive"]

# NullTrigger不可省略，否则的话，万一之前编辑过某个区域、使得全局变量里存储的值不为None，那么点击"开始填充"后全局变量里存储的值也不会自动清空（即变成None）
# "编辑填充"也需要一个trigger，这里用archiveID相当于同时也是一个trigger
a = None
try:
    if not readFromArchive:
        a = value
        print("new value used")
    else:
        print(sc.sticky["data"])
        print(sc.sticky)
        print(sc.sticky[mainWindowKey])
        if sc.sticky[mainWindowKey]["editHole"]:
            subkey = holeSubKey
        else:
            subkey = bandSubKey
        a = sc.sticky["data"][subkey][int(archiveID)-1]["radius"]
        print("archive used")
except:
    pass
    
sc.sticky[key]["readRadiusFromArchive"] = False
# ---------- end ghpython_script_13 ----------
create_true_only_button_5 = CreateTrueOnlyButton(ButtonName="生成", ButtonStyle=1)
value_listener_8 = ValueListener(Elements=create_rhino_pick_button, SomeProperty=True)  # -> Values, Indices
value_listener_9 = ValueListener(Elements=create_rhino_pick_button_2, SomeProperty=True)  # -> Values, Indices
value_listener_10 = ValueListener(Elements=create_rhino_pick_button_3, SomeProperty=True)  # -> Values, Indices
boolean_12 = Boolean(False)
boolean_13 = Boolean(False)
boolean_14 = Boolean(False)
boolean_15 = Boolean(False)
boolean_16 = Boolean(False)
boolean_17 = Boolean(False)
create_text_box_2 = CreateTextBox(Label="hsapce\t\t", DefaultText=ghpython_script_12.a, UpdateButton=boolean_16, showLabel=True)
create_text_box_3 = CreateTextBox(Label="Radius\t\t", DefaultText=ghpython_script_13.a, UpdateButton=boolean_17, showLabel=True)
create_text_box_4 = CreateTextBox(Label="vertical\t\t", DefaultText=ghpython_script_10.a, UpdateButton=boolean_12, showLabel=True)
create_text_box_5 = CreateTextBox(Label="inner radius        ", DefaultText=ghpython_script_8.a, UpdateButton=boolean_13, showLabel=True)
create_text_box_6 = CreateTextBox(Label="horizontal\t", DefaultText=ghpython_script_9.a, UpdateButton=boolean_14, showLabel=True)
merge_3 = Merge(Data1=create_rhino_pick_button, Data2=create_rhino_pick_button_3, Data3=create_rhino_pick_button_2)
create_text_box_7 = CreateTextBox(Label="vspace\t\t", DefaultText=ghpython_script_11.a, UpdateButton=boolean_15, showLabel=True)
value_listener_11 = ValueListener(Elements=create_true_only_button_5, SomeProperty=True)  # -> Values, Indices
python_3 = GhPythonScript(
    key=panel,
    ID=value_listener_10.Values,
    archiveID=ghpython_script_6.holeAreaIndex,
    NullTrigger=ghpython_script_2.NullTrigger,
    holeSubKey="hole",
    bandSubKey="band",
    mainWindowKey="mainWindowState")  # -> out, obj_id, obj, name
#   port out: The Rhino object variable
# ---------- python_3: Python ----------
__author__ = "jinxinqi"
__version__ = "2022.05.06"

import rhinoscriptsyntax as rs
import scriptcontext as sc
import ghpythonlib.components as ghcomp
import Rhino
import System


def convertStrToArrayByte(input):
    rtn = array.array("b")
    for i in range(len(input)):
        rtn.append('y')
    return rtn

doc = Rhino.RhinoDoc.ActiveDoc

readFromArchive = sc.sticky[key]["readOuterEdgeFromArchive"]

# NullTrigger不可省略，否则的话，万一之前编辑过某个区域、使得全局变量里存储的关键线id不为None，那么点击"开始填充"后全局变量里存储的关键线id也不会自动清空（即变成None）
# "编辑填充"也需要一个trigger，这里用archiveID相当于同时也是一个trigger
obj_id = None
try:
    if not readFromArchive:
        obj_id = str(ID)
        #print("new ID used: {}".format(type(obj_id)))
        print("new ID used: {}".format(System.Guid(obj_id)))
        #print("new ID used: {}".format(ID.ToByteArray.__str__()))
    else:
        if sc.sticky[mainWindowKey]["editHole"]:
            subkey = holeSubKey
        else:
            subkey = bandSubKey
        obj_id = str(sc.sticky["data"][subkey][int(archiveID)-1]["outerEdge"])
        print("archived ID used: {}".format(System.Guid(obj_id)))
except:
    pass
    
sc.sticky[key]["readOuterEdgeFromArchive"] = False

if obj_id is not None:
    obj = doc.Objects.Find(System.Guid(obj_id))
    print(obj)
    name = obj.Name
    print(name)
# ---------- end python_3 ----------
python_4 = GhPythonScript(
    key=panel,
    ID=value_listener_8.Values,
    archiveID=ghpython_script_6.holeAreaIndex,
    NullTrigger=ghpython_script_2.NullTrigger,
    holeSubKey="hole",
    bandSubKey="band",
    mainWindowKey="mainWindowState")  # -> out, obj_id, obj, name
#   port out: The Rhino object variable
# ---------- python_4: Python ----------
__author__ = "jinxinqi"
__version__ = "2022.05.06"

import rhinoscriptsyntax as rs
import scriptcontext as sc
import ghpythonlib.components as ghcomp
import Rhino
import System


def convertStrToArrayByte(input):
    rtn = array.array("b")
    for i in range(len(input)):
        rtn.append('y')
    return rtn

doc = Rhino.RhinoDoc.ActiveDoc

readFromArchive = sc.sticky[key]["readInnerEdgeFromArchive"]


# NullTrigger不可省略，否则的话，万一之前编辑过某个区域、使得全局变量里存储的关键线id不为None，那么点击"开始填充"后全局变量里存储的关键线id也不会自动清空（即变成None）
# "编辑填充"也需要一个trigger，这里用archiveID相当于同时也是一个trigger
obj_id = None 

try:
    if not readFromArchive:
        obj_id = str(ID)
        #print("new ID used: {}".format(type(obj_id)))
        print("new ID used: {}".format(System.Guid(obj_id)))
        #print("new ID used: {}".format(ID.ToByteArray.__str__()))
    else:
        if sc.sticky[mainWindowKey]["editHole"]:
            subkey = holeSubKey
        else:
            subkey = bandSubKey
        obj_id = str(sc.sticky["data"][subkey][int(archiveID)-1]["innerEdge"])
        print("archived ID used: {}".format(System.Guid(obj_id)))
except:
    pass
    
sc.sticky[key]["readInnerEdgeFromArchive"] = False

if obj_id is not None:
    obj = doc.Objects.Find(System.Guid(obj_id))
    print(obj)
    name = obj.Name
    print(name)
# ---------- end python_4 ----------
adjust_element_appearance_7 = AdjustElementAppearance(ElementsToAdjust=merge_3, FontSize=Slider(14, range=0..100))
python_5 = GhPythonScript(
    key=panel,
    ID=value_listener_9.Values,
    archiveID=ghpython_script_6.holeAreaIndex,
    NullTrigger=ghpython_script_2.NullTrigger,
    holeSubKey="hole",
    bandSubKey="band",
    mainWindowKey="mainWindowState")  # -> out, obj_id, obj, name
#   port out: The Rhino object variable
# ---------- python_5: Python ----------
__author__ = "jinxinqi"
__version__ = "2022.05.06"

import rhinoscriptsyntax as rs
import scriptcontext as sc
import ghpythonlib.components as ghcomp
import Rhino
import System


def convertStrToArrayByte(input):
    rtn = array.array("b")
    for i in range(len(input)):
        rtn.append('y')
    return rtn

doc = Rhino.RhinoDoc.ActiveDoc

readFromArchive = sc.sticky[key]["readReferEdgeFromArchive"]

# NullTrigger不可省略，否则的话，万一之前编辑过某个区域、使得全局变量里存储的关键线id不为None，那么点击"开始填充"后全局变量里存储的关键线id也不会自动清空（即变成None）
# "编辑填充"也需要一个trigger，这里用archiveID相当于同时也是一个trigger
obj_id = None
try:
    if not readFromArchive:
        obj_id = str(ID)
        #print("new ID used: {}".format(type(obj_id)))
        print("new ID used: {}".format(System.Guid(obj_id)))
        #print("new ID used: {}".format(ID.ToByteArray.__str__()))
    else:
        if sc.sticky[mainWindowKey]["editHole"]:
            subkey = holeSubKey
        else:
            subkey = bandSubKey
        obj_id = str(sc.sticky["data"][subkey][int(archiveID)-1]["referEdge"])
        print("archived ID used: {}".format(System.Guid(obj_id)))
except:
    pass
    
sc.sticky[key]["readReferEdgeFromArchive"] = False

if obj_id is not None:
    obj = doc.Objects.Find(System.Guid(obj_id))
    print(obj)
    name = obj.Name
    print(name)
# ---------- end python_5 ----------
value_listener_12 = ValueListener(Elements=create_text_box_3, SomeProperty=True)  # -> Values, Indices
value_listener_13 = ValueListener(Elements=create_text_box_5, SomeProperty=True)  # -> Values, Indices
adjust_element_positioning_6 = AdjustElementPositioning(ElementsToAdjust=merge_3, AbsolutePositioning=False, Width=Slider(150, range=0..1000))
value_listener_14 = ValueListener(Elements=create_text_box_6, SomeProperty=True)  # -> Values, Indices
value_listener_15 = ValueListener(Elements=create_text_box_7, SomeProperty=True)  # -> Values, Indices
value_listener_16 = ValueListener(Elements=create_text_box_4, SomeProperty=True)  # -> Values, Indices
value_listener_17 = ValueListener(Elements=create_text_box_2, SomeProperty=True)  # -> Values, Indices
ghpython_script_14 = GhPythonScript(
    okay=value_listener_11.Values,
    mainWindowKey="mainWindowState",
    holeWindowKey="holeAreaWindowState",
    dataKey="data",
    metadataKey="metadata",
    jsonPath="json.txt")  # -> out, editList
# ---------- ghpython_script_14: Python ----------
__author__ = "USER"
__version__ = "2022.05.30"

import rhinoscriptsyntax as rs
import scriptcontext as sc
import json
import Rhino
import os

path =Rhino.RhinoDoc.ActiveDoc.Path
dirpath = os.path.dirname(path)

def getValue(key1, key2):
    if sc.sticky[key1].has_key(key2):
        return sc.sticky[key1][key2]
    else:
        return ""
        
if (okay is not None) and okay:
    
    dataItem = {"radius": getValue(holeWindowKey, "radius"), \
                "hspace": getValue(holeWindowKey, "hspace"), \
                "vspace": getValue(holeWindowKey, "vspace"), \
                "horizontal": getValue(holeWindowKey, "horizontal"), \
                "vertical": getValue(holeWindowKey, "vertical"), \
                "innerEdge": getValue(holeWindowKey, "innerEdge"), \
                "outerEdge": getValue(holeWindowKey, "outerEdge"), \
                "referEdge": getValue(holeWindowKey, "referEdge"), \
                "innerRadius": getValue(holeWindowKey, "innerRadius")}
    print(dataItem)
    if sc.sticky[mainWindowKey]["isHole"]:
        subkey = "hole"
    else:
        subkey = "band"
    if sc.sticky[mainWindowKey]["newArea"] and not sc.sticky[mainWindowKey]["editArea"]:
        
        if not (sc.sticky.has_key(dataKey) and isinstance(sc.sticky[dataKey], dict)):
            sc.sticky[dataKey]={"hole": [], "band": []} 
        sc.sticky[dataKey][subkey].append(dataItem)
        
        if not (sc.sticky.has_key(metadataKey) and isinstance(sc.sticky[metadataKey], list)):
            sc.sticky[metadataKey] = [0,0]
        if sc.sticky[mainWindowKey]["isHole"]:
            sc.sticky[metadataKey][0] += 1
        else:
            sc.sticky[metadataKey][1] += 1
        sc.sticky[mainWindowKey]["newArea"] = False
        sc.sticky[mainWindowKey]["editArea"] = True
    elif sc.sticky[mainWindowKey]["editArea"]  and not sc.sticky[mainWindowKey]["newArea"]:
        sc.sticky[dataKey][subkey][int(sc.sticky[holeWindowKey]["holeAreaIndex"])-1] = dataItem
    else:
        raise Exception("sc.sticky[mainWindowKey][\"editArea\"]  == sc.sticky[mainWindowKey][\"newArea\"]")
    
    editList = []
    for i in range(1,sc.sticky[metadataKey][0]+1):
        editList.append("孔状区域{}".format(i))
    for i in range(1,sc.sticky[metadataKey][1]+1):
        editList.append("带状区域{}".format(i))
        
    jsonPath = dirpath + "\\" +jsonPath
    
    with open(jsonPath, "a") as f:
        data = json.dumps(sc.sticky[dataKey])
        f.write("DATA\n"+data+"\n")
        metadata = json.dumps(sc.sticky[metadataKey])
        f.write("METADATA\n"+metadata+"\n")
# ---------- end ghpython_script_14 ----------
ghpython_script_15 = GhPythonScript(okay=value_listener_11.Values, holeWindowKey="holeAreaWindowState")  # -> out, radius, hspace, vspace, horizontal, vertical, innerRadius, innerEdge, outerEdge, referEdge
# ---------- ghpython_script_15: Python ----------
__author__ = "USER"
__version__ = "2022.05.09"

import scriptcontext as sc

if not sc.sticky.has_key(holeWindowKey):
    sc.sticky[holeWindowKey] = {}
    
sc.sticky[holeWindowKey]["generate_frits"] = True

def splitStringToFloatList(string):
    rtn = []
    for item in string.split(' '):
        try:
            _ = float(item)
            rtn.append(item)
        except:
            pass
    return rtn

print(okay)
print(holeWindowKey)
if okay:
    radius = sc.sticky[holeWindowKey]["radius"]
    print(radius)
    radius = splitStringToFloatList(radius)
    print(radius)
    hspace = sc.sticky[holeWindowKey]["hspace"]
    print(hspace)
    hspace = splitStringToFloatList(hspace)
    print(hspace)
    vspace = sc.sticky[holeWindowKey]["vspace"]
    print(vspace)
    vspace = splitStringToFloatList(vspace)
    print(vspace)
    
    horizontal = sc.sticky[holeWindowKey]["horizontal"]
    print(horizontal)
    vertical = sc.sticky[holeWindowKey]["vertical"]
    print(vertical)
    innerRadius = sc.sticky[holeWindowKey]["innerRadius"]
    
    innerEdge = sc.sticky[holeWindowKey]["innerEdge"]
    print(dir(innerEdge))
    print(innerEdge)
    outerEdge = sc.sticky[holeWindowKey]["outerEdge"]
    print(outerEdge)
    referEdge = sc.sticky[holeWindowKey]["referEdge"]
    print(referEdge)
    out = True
else:
    out = False
# ---------- end ghpython_script_15 ----------
merge_4 = Merge(
    Data1=create_text_box_3,
    Data2=create_text_box_2,
    Data3=create_text_box_7,
    Data4=create_text_box_6,
    Data5=create_text_box_4,
    Data6=create_text_box_5,
    Data7=create_text_box)
adjust_element_appearance_8 = AdjustElementAppearance(ElementsToAdjust=merge_4, FontSize=Slider(16, range=0..100))
python_data_collector = GhPythonScript(key="holeAreaWindowState", innerEdge=python_4.obj_id, outerEdge=python_3.obj_id, referEdge=python_5.obj_id)  # -> out, a
# ---------- python_data_collector: Python ----------
__author__ = "USER"
__version__ = "2022.05.09"

import scriptcontext as sc

if not sc.sticky.has_key(key):
    sc.sticky[key] = {}

sc.sticky[key]["innerEdge"] = innerEdge
sc.sticky[key]["outerEdge"] = outerEdge
sc.sticky[key]["referEdge"] = referEdge
# ---------- end python_data_collector ----------
create_label_5 = CreateLabel(LabelText="拾取几何轮廓", LabelSize=Slider(24, range=0..100), Justification=0)
python_data_collector_2 = GhPythonScript(
    key="holeAreaWindowState",
    radius=value_listener_12.Values,
    hspace=value_listener_17.Values,
    vspace=value_listener_15.Values,
    horizontal=value_listener_14.Values,
    vertical=value_listener_16.Values,
    innerRadius=value_listener_13.Values)  # -> out, a
# ---------- python_data_collector_2: Python ----------
__author__ = "USER"
__version__ = "2022.05.09"

import scriptcontext as sc

if not sc.sticky.has_key(key):
    sc.sticky[key] = {}

sc.sticky[key]["radius"] = radius
sc.sticky[key]["hspace"] = hspace
sc.sticky[key]["vspace"] = vspace
sc.sticky[key]["horizontal"] = horizontal
sc.sticky[key]["vertical"] = vertical
sc.sticky[key]["innerRadius"] = innerRadius
# ---------- end python_data_collector_2 ----------
merge_5 = Merge(Data1=create_label_5, Data2=create_rhino_pick_button, Data4=create_rhino_pick_button_3, Data5=create_rhino_pick_button_2)
boolean_18 = Boolean(False)
panel_6 = Panel(ghpython_script_15.outerEdge)
create_label_6 = CreateLabel(LabelText="花点参数设置(mm)", LabelSize=Slider(24, range=0..100), Justification=0)
merge_6 = Merge(
    Data1=create_label_6,
    Data2=create_text_box_3,
    Data3=create_text_box_2,
    Data4=create_text_box_7,
    Data5=create_text_box_6,
    Data6=create_text_box_4,
    Data7=create_text_box_5,
    Data8=create_text_box)
create_stack_3 = CreateStack(UIElements=merge_5, Horizontal=boolean_18)
boolean_19 = Boolean(False)
create_border_2 = CreateBorder(UIElement=create_stack_3, BorderThickness=Slider(0, range=0..100), BorderColor=RGB(0, 0, 0), CornerRadius=0)
create_stack_4 = CreateStack(UIElements=merge_6, Horizontal=boolean_19)
panel_7 = Panel("""流程：
1.选线；
2.填参数；
3.点击生成；""")
create_text_block = CreateTextBlock(Text=panel_7, TextSize=Slider(16, range=0..100), Justification=0)
create_label_7 = CreateLabel(LabelText="填充说明", LabelSize=Slider(24, range=0..100), Justification=0)
create_border_3 = CreateBorder(UIElement=create_stack_4, BorderThickness=Slider(0, range=0..100), BorderColor=RGB(0, 0, 0), CornerRadius=0)
adjust_element_positioning_7 = AdjustElementPositioning(ElementsToAdjust=create_border_3, Margin="0,10,0,0", AbsolutePositioning=False)
create_image_2 = CreateImage(ImageSource=python.logopath, ImageWidth=Slider(100, range=0..100), ImageHeight=Slider(22, range=0..100))
merge_7 = Merge(Data1=create_label_7, Data2=create_text_block)
boolean_20 = Boolean(False)
boolean_21 = Boolean(False)
create_stack_5 = CreateStack(UIElements=merge_7, Horizontal=boolean_21)
adjust_element_positioning_8 = AdjustElementPositioning(
    ElementsToAdjust=create_image_2,
    Margin="0,35,0,0",
    AbsolutePositioning=False,
    HorizontalAlignment=Slider(2, range=0..10))
tab_names = Panel("""孔状区域
带状区域
块状区域""")
boolean_22 = Boolean(True)
adjust_element_positioning_9 = AdjustElementPositioning(ElementsToAdjust=create_stack_5, AbsolutePositioning=False, Width=Slider(150, range=0..1000))

merge_8 = Merge(Data1=create_true_only_button, Data2=create_true_only_button_5)
create_stack_6 = CreateStack(UIElements=merge_8, Horizontal=True)

adjust_element_positioning_10 = AdjustElementPositioning(ElementsToAdjust=merge_8, Margin="0,10,10,0", AbsolutePositioning=False, Width=Slider(150, range=0..1000))
adjust_element_appearance_9 = AdjustElementAppearance(ElementsToAdjust=merge_8, FontSize=Slider(14, range=0..100))
merge_9 = Merge(Data1=create_border_2, Data2=create_border_3, Data3=create_stack_6, Data4=create_image_2)
create_stack_7 = CreateStack(UIElements=merge_9, Horizontal=boolean_20)
merge_10 = Merge(Data1=create_stack_5, Data2=create_stack_7)
adjust_element_positioning_11 = AdjustElementPositioning(ElementsToAdjust=create_stack_7, AbsolutePositioning=False, Width=Slider(500, range=0..1000))
create_stack_8 = CreateStack(UIElements=merge_10, Horizontal=boolean_22)
tabbed_view = TabbedView(TabNames=tab_names, TabTextSize=Slider(30, range=0..100), Tab0=flatten(create_stack_8))
add_elements = AddElements(Window=launch_window_2, Elements=flatten(tabbed_view), DoVLChecking=True)  # -> AddedElements, ElementNames
adjust_element_positioning_12 = AdjustElementPositioning(ElementsToAdjust=tabbed_view, AbsolutePositioning=False, HorizontalAlignment=Slider(0, range=0..100))

adjust_element_positioning_13 = AdjustElementPositioning(ElementsToAdjust=create_stack_6, AbsolutePositioning=False, HorizontalAlignment="1")
curve = Curve(ghpython_script_15.referEdge)
curve_2 = Curve(ghpython_script_15.outerEdge)
curve_3 = Curve(ghpython_script_15.innerEdge)
horizontal = Number(ghpython_script_15.horizontal)
vertical = Number(ghpython_script_15.vertical)
lng = ListLength(List=ghpython_script_15.vspace)
python_6 = GhPythonScript(horizontal=horizontal, vertical=vertical)  # -> out, uvfactor, hypotenuse
# ---------- python_6: Python ----------
__author__ = "DELL"
__version__ = "2022.05.07"

import rhinoscriptsyntax as rs
import math

uvfactor = ((horizontal/2)*math.sqrt(3))/vertical
hypotenuse = math.sqrt(vertical*vertical + (horizontal/2)*(horizontal/2))
# ---------- end python_6 ----------
min = Minimum(A=horizontal, B=vertical)
max = Maximum(A=horizontal, B=vertical)
panel_8 = Panel(ghpython_script_15.vspace)
division = Division(A=lng, B=2)
round = Round(Number=division)  # -> Nearest, Floor, Ceiling
subtraction = Subtraction(A=round.Floor, B=1)
item_2 = ListItem(List=ghpython_script_15.vspace, Index=subtraction, Wrap=True)

cluster = Cluster(referedge=curve, radius=ghpython_script_15.radius, vspace=ghpython_script_15.vspace, hspace=ghpython_script_15.hspace)
data = Data(cluster)
lng_2 = ListLength(List=data)
subtraction_2 = Subtraction(A=lng_2, B=1)
item_3 = ListItem(List=data, Index=0, Wrap=True)
item_4 = ListItem(List=data, Index=subtraction_2, Wrap=True)
D = Dict(item_4)

division_2 = Division(A=1, B=python_6.uvfactor)

cluster_2 = Cluster_7(outercrv=curve_2, innercrv=curve_3)  # -> outercrv_2, innercrv_2
len = Length(Curve=curve)

# ---- group: FritsBaking
ghpython_script_16 = GhPythonScript(radius=ghpython_script_15.innerRadius)  # -> output, pts, radiuses; inputs pts: list of Point3d
# ---------- ghpython_script_16: Python ----------
"""
Reference: https://medium.com/generative-design/working-with-geometry-in-python-a256de7bb1b1#:~:text=The%20three%20main%20libraries%20provided%20by%20Rhino%2FGrasshopper%20which,and%20data%20types%20in%20the%20main%20RhinoCommon%20library"""

__author__ = "USER"
__version__ = "2022.05.27"

radiuses = []
for i in range(len(pts)):
    radiuses.append(radius)
# ---------- end ghpython_script_16 ----------
ghpython_script_17 = GhPythonScript(
    holeWindowKey="holeAreaWindowState",
    mainWindowKey="mainWindowState",
    pts=ghpython_script_16.pts,
    radiuses=ghpython_script_16.radiuses)  # -> out, okay; inputs pts: list of Point3d, radiuses: list
# ---------- ghpython_script_17: Python ----------
"""
Reference: https://medium.com/generative-design/working-with-geometry-in-python-a256de7bb1b1#:~:text=The%20three%20main%20libraries%20provided%20by%20Rhino%2FGrasshopper%20which,and%20data%20types%20in%20the%20main%20RhinoCommon%20library"""

__author__ = "USER"
__version__ = "2022.05.27"

import rhinoscriptsyntax as rs
import scriptcontext as sc
import Rhino
import ghpythonlib.components as ghcomp
import Rhino.Geometry as rg
import Rhino.DocObjects as rd

if sc.sticky[holeWindowKey].has_key("generate_frits_in_block") \
    and sc.sticky[holeWindowKey]["generate_frits_in_block"]:
    
    try:

        assert len(pts) == len(radiuses)
        
        if sc.sticky[mainWindowKey]["isHole"]:
            area_type = "hole-block"
            area_idx = sc.sticky[holeWindowKey]["holeAreaIndex"]
        else:
            raise NotImplementedError("not implemented!")
            
        circleName = "circle-{}-{}".format(area_type, area_idx)    
       
        #we change the sc
        sc.doc = Rhino.RhinoDoc.ActiveDoc
        
        toDeleteList = []
        for obj in sc.doc.Objects:
            if obj.Name is not None:
                if obj.Name == circleName:
                    toDeleteList.append(obj)
            
        for obj in toDeleteList:
            sc.doc.Objects.Delete(obj)
            
        for idx, pt in enumerate(pts):
            print("idx={}\n".format(idx))
            print(pt)
            radius = float(radiuses[idx])
            print(radius)
            print(type(radius))
            circle = rg.Circle(pt, radius)
            attributes = rd.ObjectAttributes()
            attributes.Name = circleName
            #we add both the geometry and the attributes to the Rhino doc
            circle_id = sc.doc.Objects.AddCircle(circle, attributes)
        
        okay = True
        
    except Exception as e:
        
        okay = False
        
        #we put back the original Grasshopper document as default
        sc.doc = ghdoc
        sc.sticky[holeWindowKey]["generate_frits_in_block"] = False
        raise e
        
    #we put back the original Grasshopper document as default
    sc.doc = ghdoc
    sc.sticky[holeWindowKey]["generate_frits_in_block"] = False
# ---------- end ghpython_script_17 ----------

# ---- group: Radius
cluster_3 = Cluster_2(crv=cluster_2.innercrv_2, rowconf=item_3)  # -> pts, vec_2, radius, refer_pts, refer_vec, bottom_border
cluster_4 = Cluster_3(crv=cluster_2.outercrv_2, refer_pts=cluster_3.refer_pts, refer_vec=cluster_3.refer_vec, refer_dis=len, D=D)  # -> top_subcrv, refer_pts_2
pt = Point(cluster_3.refer_pts)
display = Display(pts=cluster_3.pts, radius=cluster_3.radius)
cluster_5 = Cluster_4(refer_pts=cluster_4.refer_pts_2, crv=cluster_2.outercrv_2, refer_dis=len, D=D, top_subcrv=cluster_4.top_subcrv)  # -> pts, offset_curve, radius, top_border
python_7 = GhPythonScript(
    inner_refer_pts=cluster_3.refer_pts,
    outer_refer_pts=cluster_4.refer_pts_2,
    row_confs=cluster,
    inner_crv=cluster_2.innercrv_2,
    outer_crv=cluster_2.outercrv_2,
    refer_dis=len,
    top_border=cluster_5.top_border,
    bottom_border=cluster_3.bottom_border)  # -> out, inside_refer_pts, inside_radius, top_border_updated, bottom_border_updated, bottom_border_pts, top_border_pts; inputs inner_refer_pts: list of Point3d, outer_refer_pts: list of Point3d, row_confs: list, inner_crv: Curve, outer_crv: Curve, top_border: Curve, bottom_border: Curve, top_row_num: Int32, bottom_row_num: Int32, ref_border: Curve
# ---------- python_7: Python ----------
__author__ = "wangxu"
__version__ = "2022.05.06"

import rhinoscriptsyntax as rs
import ghpythonlib.components as ghcomp

row_num = ghcomp.ListLength(row_confs)
print(row_num)

#print(row_confs)
#print(row_num)
inside_row_num = row_num - 2
bottom_inside_row_num = int((inside_row_num + 1) / 2)
#print(bottom_inside_row_num)
top_inside_row_num = inside_row_num - bottom_inside_row_num

inside_refer_pts = []
inside_radius = []
bottom_border_pts = []
top_border_pts = []

for i in range(bottom_inside_row_num):
    current_row_conf = ghcomp.ListItem(row_confs, i + 1, True)
    _, current_offset, _ = ghcomp.Dhictionary.DictSelect([current_row_conf], 'offset')
    _, current_radius, _ = ghcomp.Dhictionary.DictSelect([current_row_conf], 'radius')
    #print(current_radius)
    current_crv = ghcomp.OffsetCurve(inner_crv, current_offset)
    bottom_border = ghcomp.OffsetCurve(current_crv, current_radius)
    P, t, D = ghcomp.CurveClosestPoint(inner_refer_pts, current_crv)
    if i % 2 == 0:
        # mapping to inner line
        #print(ghcomp.ListLength(P))
        P1 = ghcomp.CullIndex(P, ghcomp.ListLength(P) - 1)
        #print(ghcomp.ListLength(P1))
        P2 = ghcomp.CullIndex(P, 0)
        P3 = ghcomp.Addition(P1, P2)
        P4 = ghcomp.Division(P3, 2)
        #print(ghcomp.ListLength(P4))
        P5, _, _ = ghcomp.CurveClosestPoint(P4, current_crv)
        inside_refer_pts += P5
        if i == (bottom_inside_row_num - 1):
            bottom_border_pts += P5
        for j in range(len(P5)):
            inside_radius.append(current_radius)

    else:
        # mapping to outer line
        inside_refer_pts += P
        if i == (bottom_inside_row_num - 1):
            bottom_border_pts += P
        for j in range(len(P)):
            inside_radius.append(current_radius)
        

for i in range(bottom_inside_row_num, inside_row_num):
    next_row_conf = ghcomp.ListItem(row_confs, i+2, True)
    current_row_conf = ghcomp.ListItem(row_confs, i+1, True)
    _, current_offset, _ = ghcomp.Dhictionary.DictSelect([current_row_conf], 'offset')
    _, current_radius, _ = ghcomp.Dhictionary.DictSelect([current_row_conf], 'radius')
    #print(current_radius)
    _, current_vspace, _ = ghcomp.Dhictionary.DictSelect([current_row_conf], 'vspace')
    _, next_vspace, _ = ghcomp.Dhictionary.DictSelect([next_row_conf], 'vspace')
    crv_offset = refer_dis - current_offset
    current_crv = ghcomp.OffsetCurve(outer_crv, -crv_offset)
    P, t, D = ghcomp.CurveClosestPoint(outer_refer_pts, current_crv)
    print(i, current_vspace)
    top_border = ghcomp.OffsetCurve(top_border, -next_vspace)
    
    if i % 2 == 0:
        # mapping to inner line
        #print('here')
        #print(ghcomp.ListLength(P))
        P1 = ghcomp.CullIndex(P, ghcomp.ListLength(P) - 1)
        #print(ghcomp.ListLength(P1))
        P2 = ghcomp.CullIndex(P, 0)
        P3 = ghcomp.Addition(P1, P2)
        P4 = ghcomp.Division(P3, 2)
        #print(ghcomp.ListLength(P4))
        P5, _, _ = ghcomp.CurveClosestPoint(P4, current_crv)
        inside_refer_pts += P5
        if i == bottom_inside_row_num:
            top_border_pts += P5
        for j in range(len(P5)):
            inside_radius.append(current_radius)
    else:
        # mapping to outer line
        inside_refer_pts += P
        if i == bottom_inside_row_num:
            top_border_pts += P
        for j in range(len(P)):
            inside_radius.append(current_radius)

top_border_updated = top_border
bottom_border_updated = bottom_border
print("finish")
# ---------- end python_7 ----------
crv = Curve(cluster_4.top_subcrv)
pt_2 = Point(cluster_4.refer_pts_2)
crv_2 = Curve(cluster_3.bottom_border)
merge_11 = Merge(Data1=cluster_3.pts)
shifthalf = Shifthalf(P=cluster_5.pts, crv=cluster_5.offset_curve)
crv_3 = Curve(cluster_5.offset_curve)
crv_4 = Curve(cluster_5.top_border)
pt_3 = Point(cluster_5.pts)
python_8 = GhPythonScript(aligned_pts=cluster_5.pts, shifted_pts=shifthalf, row_confs=cluster)  # -> out, outer_pts; inputs aligned_pts: list of Point3d, shifted_pts: list of Point3d, row_confs: list
# ---------- python_8: Python ----------
__author__ = "zhengyawen"
__version__ = "2022.05.07"

import rhinoscriptsyntax as rs
import ghpythonlib.components as ghcomp

row_num = ghcomp.ListLength(row_confs)
print(row_num)

outer_pts = []
if(row_num % 2 == 0):
    outer_pts = shifted_pts
else:
    outer_pts = aligned_pts
    
print("finish")
# ---------- end python_8 ----------
display_2 = Display(pts=python_8.outer_pts, radius=cluster_5.radius)
pt_4 = Point(python_7.inside_refer_pts)
crv_5 = Curve(python_7.bottom_border_updated)
crv_6 = Curve(python_7.top_border_updated)
panel_9 = Panel(merge_11)
display_3 = Display(pts=pt_4, radius=python_7.inside_radius)
srf = Surface(display_3)

# ---- group: FritsBaking
ghpython_script_18 = GhPythonScript(pts=python_8.outer_pts, radius=cluster_5.radius)  # -> output, pts, radiuses; inputs pts: list of Point3d; same code as ghpython_script_16
ghpython_script_19 = GhPythonScript(pts=cluster_3.pts, radius=cluster_3.radius)  # -> output, pts, radiuses; inputs pts: list of Point3d; same code as ghpython_script_16
merge_12 = Merge(Data1=ghpython_script_19.pts, Data2=ghpython_script_18.pts, Data3=pt_4)  # -> flatten(Result)
merge_13 = Merge(Data1=ghpython_script_19.radiuses, Data2=ghpython_script_18.radiuses, Data3=python_7.inside_radius)  # -> flatten(Result)
ghpython_script_20 = GhPythonScript(holeWindowKey="holeAreaWindowState", mainWindowKey="mainWindowState", pts=merge_12, radiuses=merge_13)  # -> out, okay, trigger; inputs pts: list of Point3d, radiuses: list
# ---------- ghpython_script_20: Python ----------
"""
Reference: https://medium.com/generative-design/working-with-geometry-in-python-a256de7bb1b1#:~:text=The%20three%20main%20libraries%20provided%20by%20Rhino%2FGrasshopper%20which,and%20data%20types%20in%20the%20main%20RhinoCommon%20library"""

__author__ = "USER"
__version__ = "2022.05.27"

import rhinoscriptsyntax as rs
import scriptcontext as sc
import Rhino
import ghpythonlib.components as ghcomp
import Rhino.Geometry as rg
import Rhino.DocObjects as rd

if sc.sticky[holeWindowKey].has_key("generate_frits") \
    and sc.sticky[holeWindowKey]["generate_frits"]:
    
    try:

        assert len(pts) == len(radiuses)
        
        if sc.sticky[mainWindowKey]["isHole"]:
            area_type = "hole"
            area_idx = sc.sticky[holeWindowKey]["holeAreaIndex"]
        else:
            raise NotImplementedError("not implemented!")
            
        circleName = "circle-{}-{}".format(area_type, area_idx)    
       
        #we change the sc
        sc.doc = Rhino.RhinoDoc.ActiveDoc
        
        toDeleteList = []
        for obj in sc.doc.Objects:
            if obj.Name is not None:
                if obj.Name == circleName:
                    toDeleteList.append(obj)
            
        for obj in toDeleteList:
            sc.doc.Objects.Delete(obj)
            
        for idx, pt in enumerate(pts):
            print("idx={}\n".format(idx))
            print(pt)
            radius = radiuses[idx]
            print(radius)
            circle = rg.Circle(pt, radius)
            attributes = rd.ObjectAttributes()
            attributes.Name = circleName
            #we add both the geometry and the attributes to the Rhino doc
            circle_id = sc.doc.Objects.AddCircle(circle, attributes)
            
        okay = True
            
    except Exception as e:
        
        okay = False
        
        #we put back the original Grasshopper document as default
        sc.doc = ghdoc
        sc.sticky[holeWindowKey]["generate_frits"] = False
        raise e
        
    #we put back the original Grasshopper document as default
    sc.doc = ghdoc
    sc.sticky[holeWindowKey]["generate_frits"] = False
# ---------- end ghpython_script_20 ----------

# ----
panel_10 = Panel(cluster_3.pts)
srf_2 = Surface(display)
pt_5 = Point(python_7.bottom_border_pts)
pt_6 = Point(python_7.top_border_pts)
srf_3 = Surface(display_2)
selectborder = Selectborder(top_border1=python_8.outer_pts, top_border2=pt_6, bottom_border1=cluster_3.pts, bottom_border2=pt_5)  # -> out, top_border, bottom_border; inputs top_border1: list of Point3d, top_border2: list of Point3d, bottom_border1: list of Point3d, bottom_border2: list of Point3d
# ---------- selectborder: Python ----------
__author__ = "DELL"
__version__ = "2022.07.06"

import rhinoscriptsyntax as rs

top_border = top_border2
bottom_border = bottom_border2

if len(top_border)==0:
    top_border = top_border1

if len(bottom_border)==0:
    bottom_border = bottom_border1
# ---------- end selectborder ----------
pt_7 = Point(python_8.outer_pts)
pointalongcurve = PointAlongCurve(P=selectborder.top_border, C=crv_6, A=ghpython_script_15.hspace)
pt_8 = Point(selectborder.bottom_border)
pt_9 = Point(selectborder.top_border)
pt_10 = Point(pointalongcurve)
pline = PolyLine(Vertices=pt_10, Closed=False)
rev = ReverseList(List=pt_10)

cp = ControlPoints(Curve=crv_6)  # -> Points, Weights, Knots
crv_cp_2 = CurveClosestPoint(Point=cp.Points, Curve=crv_5)  # -> Point, Parameter, Distance
item_5 = ListItem(List=crv_cp_2.Parameter, Index=0, Wrap=True)
lng_3 = ListLength(List=crv_cp_2.Parameter)
subtraction_3 = Subtraction(A=lng_3, B=1)
item_6 = ListItem(List=crv_cp_2.Parameter, Index=subtraction_3, Wrap=True)
dom = ConstructDomain(DomainStart=item_5, DomainEnd=item_6)
subcrv = SubCurve(BaseCurve=crv_5, Domain=dom)
crv_7 = Curve(subcrv)

pointalongcurve_2 = PointAlongCurve(P=selectborder.bottom_border, C=crv_7, A=ghpython_script_15.hspace)
pt_11 = Point(pointalongcurve_2)
merge_14 = Merge(Data1=rev, Data2=pt_11)  # -> flatten(Result)
pline_2 = PolyLine(Vertices=pt_11, Closed=False)
pline_3 = PolyLine(Vertices=merge_14, Closed=False)
pt_12 = Point(merge_14)
ccx = CurveCurve(CurveA=crv_6, CurveB=crv_7)  # -> Points, ParamsA, ParamsB
clscrv = CloseCurve(Curve=pline_3, CloseType=0, Bulge=0.5, Tolerance=0)  # -> Closed, R
lng_4 = ListLength(List=pt_12)
cluster_6 = Cluster_6(crv1=crv_6, crv2=crv_7, t1=ccx.ParamsA, t2=ccx.ParamsB)
multiplication = Multiplication(A=horizontal, B=0.5)
addition = Addition(A=horizontal, B=vertical)
addition_2 = Addition(A=item_2, B=multiplication)
division_3 = Division(A=addition, B=2)
addition_3 = Addition(A=division_3, B=item_2)
division_4 = Division(A=addition_3, B=2)
multiplication_2 = Multiplication(A=division_4, B=-3)
multiplication_3 = Multiplication(A=addition_2, B=-0.5)
offset = OffsetCurve(Curve=cluster_6, Distance=multiplication_2, Corners=1)

num_2 = Number(4)
edges = BrepEdges(Brep=cluster_6)  # -> Naked, Interior, NonManifold
offset_2 = OffsetCurve(Curve=cluster_6, Distance=multiplication_3, Corners=num_2)
join = JoinCurves(Curves=edges.Naked, Preserve=False)
divide = DivideCurve(Curve=offset_2, Count=10, Kinks=False)  # -> Points, Tangents, Parameters
crv_8 = Curve(offset_2)
pline_4 = PolyLine(Vertices=divide.Points, Closed=False)
pcen = PolygonCenter(Polyline=pline_4)  # -> CenterV, CenterE, CenterA
scale_nu = ScaleNU(Geometry=offset_2, Plane=pcen.CenterV, ScaleX=1, ScaleY=python_6.uvfactor, ScaleZ=1)  # -> Geometry, Transform
srf_4 = Surface(scale_nu.Geometry)
edges_2 = BrepEdges(Brep=srf_4)  # -> Naked, Interior, NonManifold
join_2 = JoinCurves(Curves=edges_2.Naked, Preserve=False)
crv_9 = Curve(join_2)
meshref = MeshRef(crv=crv_9, horizontal=horizontal, vertical=horizontal, surround=horizontal)  # -> mesh_2, vernum_2, upleftbasept_2, direction_2
mesh = Mesh(meshref.mesh_2)
crv_10 = Curve(offset_2)
medges = MeshEdges(Mesh=mesh)  # -> NakedEdges, InteriorEdges, NonManifoldEdges

wait_for_it = GhPythonScript(wait_for_frits=ghpython_script_20.trigger, wait_for_blcok_area=mesh)  # -> out, okay; inputs wait_for_frits: list
# ---------- wait_for_it: Python ----------
__author__ = "USER"
__version__ = "2022.05.29"

import rhinoscriptsyntax as rs

okay=True
# ---------- end wait_for_it ----------
ghpython_script_21 = GhPythonScript(mainWindowKey="mainWindowState", holeWindowKey="holeAreaWindowState", okay=wait_for_it.okay)  # -> out, okay
# ---------- ghpython_script_21: Python ----------
__author__ = "USER"
__version__ = "2022.05.25"

import rhinoscriptsyntax as rs
import scriptcontext as sc

if okay and sc.sticky[mainWindowKey]["isHole"]:
    sc.sticky[holeWindowKey]["generate_save_meshes"] = True
# ---------- end ghpython_script_21 ----------
ghpython_script_22 = GhPythonScript(holeWindowKey="holeAreaWindowState", okay=ghpython_script_21.okay, block=mesh, exportMeshPath="mesh.ply")  # -> out, rhino_obj, trigger
# ---------- ghpython_script_22: Python ----------
__author__ = "USER"
__version__ = "2022.05.07"

import rhinoscriptsyntax as rs
import scriptcontext
import Rhino
import os

path =Rhino.RhinoDoc.ActiveDoc.Path
dirpath = os.path.dirname(path)

def MeshOptions(a,b,c,d,e,f,g,h,i,j,k):
    mo="_DetailedOptions _JaggedSeams={} _PackTextures={} ".format(a,b)
    mo+="_Refine={} _SimplePlane={} _AdvancedOptions _Angle={} ".format(c,d,e)
    mo+="_AspectRatio={} _Distance={} _Density={} _Grid={} ".format(f,g,h,i)
    mo+="_MaxEdgeLength={} _MinEdgeLength={} _Enter _Enter".format(j,k)
    return mo

if okay and scriptcontext.sticky[holeWindowKey]["generate_save_meshes"]:
    try:
        print(type(block))     #debug message to Python output
        
        #we obtain the reference in the Rhino doc
        doc_object = ghdoc.Objects.Find(block)
        print(type(doc_object))
        
        attributes = doc_object.Attributes
        print('the type of attributes is: ' + str(type(attributes)))     #debug message to Python output
    
        geometry = doc_object.Geometry
        print('the type of geometry is: ' + str(type(doc_object)))     #debug message to Python output
    
        #we change the scriptcontext
        scriptcontext.doc = Rhino.RhinoDoc.ActiveDoc
        
        #we add both the geometry and the attributes to the Rhino doc
        rhino_obj = scriptcontext.doc.Objects.Add(geometry, attributes)
        print('the Rhino doc ID is: ' + str(rhino_obj))     #debug message to Python output
    
        #we select the object generated via baking
        #rhino_objs = scriptcontext.doc.Objects
        #for obj in rhino_objs:
        #    scriptcontext.doc.Objects.Find(obj.Id).Select(False)
        rs.UnselectAllObjects()
        print(scriptcontext.doc.Objects.Find(rhino_obj).Id)
        scriptcontext.doc.Objects.Find(rhino_obj).Select(True)
        
        #we convert the object to a mesh
        #rs.Command("!_-Mesh "+MeshOptions("No","Yes","Yes","Yes",0,0,0.01,0,0,0,0))
        
        #we export the mesh
        exportMeshPath = dirpath + "\\" + exportMeshPath
        rs.Command("!_-ExportWithOrigin 0,0,0 {} _EnterEnd".format(exportMeshPath))
        
        #we call instant-meshes
        #os.system(instant-meshes-path)
        
    except:
        pass
        
    scriptcontext.sticky[holeWindowKey]["generate_save_meshes"] = False
    
    #we put back the original Grasshopper document as default
    scriptcontext.doc = ghdoc
# ---------- end ghpython_script_22 ----------
panel_11 = Panel(ghpython_script_22.out)
wait_for_it_2 = GhPythonScript(wait_for_original_mesh=ghpython_script_22.rhino_obj)  # -> out, okay; same code as wait_for_it
ghpython_script_23 = GhPythonScript(mainWindowKey="mainWindowState", holeWindowKey="holeAreaWindowState", okay=wait_for_it_2.okay)  # -> out, okay
# ---------- ghpython_script_23: Python ----------
__author__ = "USER"
__version__ = "2022.05.25"

import rhinoscriptsyntax as rs
import scriptcontext as sc

if okay and sc.sticky[mainWindowKey]["isHole"]:
    sc.sticky[holeWindowKey]["open_instant_meshes"] = True
# ---------- end ghpython_script_23 ----------
ghpython_script_24 = GhPythonScript(
    mainWindowKey="mainWindowState",
    holeWindowKey="holeAreaWindowState",
    dataKey="data",
    metadataKey="metadata",
    okay=ghpython_script_23.okay,
    exportMeshPath="mesh.ply",
    processedMeshPath="mesh_a.ply",
    instant_meshes_path="InstantMeshes.exe")  # -> out, returnValue, BlockName
# ---------- ghpython_script_24: Python ----------
__author__ = "USER"
__version__ = "2022.05.07"

import rhinoscriptsyntax as rs
import scriptcontext as sc
import os
import json
import Rhino

path =Rhino.RhinoDoc.ActiveDoc.Path
dirpath = os.path.dirname(path)

if okay and sc.sticky[holeWindowKey]["open_instant_meshes"]:
    processedMeshPath = dirpath + "\\" + processedMeshPath
    instant_meshes_path = dirpath + "\\" + instant_meshes_path
    print(processedMeshPath)
    print(instant_meshes_path)
    
    try:
        # We call instant meshes
        #s = "".join(os.popen("{} -o C:\\Users\\USER\\Desktop\\mesh_a.ply -r 6 -p 6 -t 8 -d -D -v {} -b C:\\Users\\USER\\Desktop\\mesh.ply".format(instant_meshes_path, int(num))).readlines())
        returnValue = os.system("{} -o {} -r 6 -p 6 -t 8 -d -D -v {} -b {}".format(instant_meshes_path, processedMeshPath, int(num), exportMeshPath))
        if returnValue==0:
            # We import the generated meshes
            print(sc.sticky)
            print("HoleBlock{}".format(sc.sticky[holeWindowKey]["holeAreaIndex"]))
            sc.doc = Rhino.RhinoDoc.ActiveDoc
            BlockName = "HoleBlock{}".format(sc.sticky[holeWindowKey]["holeAreaIndex"])
            print(BlockName)
            for obj in sc.doc.Objects:
                sc.doc.Objects.Find(obj.Id).Select(False)
            print(type(rs.ObjectsByName(BlockName)))
            for obj in rs.ObjectsByName(BlockName):
                print(obj)
                sc.doc.Objects.Find(obj).Select(True)
                rs.Command("!_-Delete _EnterEnd")
            sc.doc = ghdoc
            rs.Command("!_-Import {} _EnterEnd".format(processedMeshPath))
            #BlockName = "HoleBlock{}".format(1 if not (sc.sticky.has_key(metadataKey) and isinstance(sc.sticky[metadataKey], int)) else sc.sticky[metadataKey] + 1)
            rs.Command("!_-SetObjectName {} _EnterEnd".format(BlockName))
            
            sc.sticky[holeWindowKey]["generate_frits_in_block"] = True
            
    except:
        pass
    sc.sticky[holeWindowKey]["open_instant_meshes"] = False
# ---------- end ghpython_script_24 ----------
panel_12 = Panel(ghpython_script_24.out)

meshprefill = MeshRef(crv=offset, horizontal=horizontal, vertical=vertical, surround=ghpython_script_15.hspace)  # -> mesh_2, vernum_2, upleftbasept_2, direction_2
python_9 = GhPythonScript(Crv=cluster_6, horizontal=horizontal, vertical=vertical, surround=ghpython_script_15.hspace, aligned=Toggle(False))  # -> out, Pt, threshold, stepCrv; inputs Crv: Curve, aligned: Boolean
# ---------- python_9: Python ----------
__author__ = "DELL"
__version__ = "2022.07.18"

import rhinoscriptsyntax as rs
import Rhino.Geometry as rg
import math

Pt = []

threshold = min(horizontal, vertical)
stepCrv = int(math.ceil(Crv.GetLength()/surround))

bbox = Crv.GetBoundingBox(True)

leftup = bbox.Min
bottomright = bbox.Max

xStart = leftup.X
xEnd = bottomright.X
yStart = leftup.Y
yEnd = bottomright.Y

xLength = xEnd - xStart
yLength = yEnd - yStart 

xCount = int(math.ceil(xLength / horizontal))
yCount = int(math.ceil(yLength / vertical))
print(xCount, yCount)

for i in range(xCount + 1):
    for j in range(yCount + 1):
        if aligned == True:
            pt = rg.Point3d(xStart + i*horizontal, yStart + j*vertical, 0)
        else:
            if j%2 == 0:
                pt = rg.Point3d(xStart + i*horizontal, yStart + j*vertical, 0)
            else:
                pt = rg.Point3d(xStart + (i+0.5)*horizontal, yStart + j*vertical, 0)
        
        PtCtmt = Crv.Contains(pt)
        if PtCtmt == rg.PointContainment.Inside:
            Pt.append(pt)
        #else:
            #t = Crv.ClosestPoint(pt)
            #ptCrv = Crv.PointAt(t[1])
            #distance = ptCrv.DistanceTo(pt)
            #if distance < threshold/3:
                #Pt.append(pt)
# ---------- end python_9 ----------
multiplication_4 = Multiplication(A=python_9.stepCrv, B=3)
divide_2 = DivideCurve(Curve=offset, Count=multiplication_4, Kinks=False)  # -> Points, Tangents, Parameters
pt_13 = Point(divide_2.Points)
crv_11 = Curve(pline)
crv_12 = Curve(pline_2)
crv_13 = Curve(join)
pt_14 = Point(python_9.Pt)
cp_2 = ClosestPoint(Point=divide_2.Points, Cloud=python_9.Pt)  # -> ClosestPoint, CPIndex, Distance
dcon = DeleteConsecutive(Set=cp_2.ClosestPoint, Wrap=False)  # -> Set, Count
cir = Circle(Plane=pt_14, Radius=ghpython_script_15.innerRadius)
pt_15 = Point(pt_12)
crv_14 = Curve(cluster_6)
crv_15 = Curve(offset)
pt_16 = Point(dcon.Set)
multiplication_5 = Multiplication(A=division_4, B=-2)
multiplication_6 = Multiplication(A=division_4, B=-0.75)
offset_3 = OffsetCurve(Curve=crv_14, Distance=multiplication_6, Corners=1)
offset_4 = OffsetCurve(Curve=crv_14, Distance=multiplication_5, Corners=1)
crv_16 = Curve(offset_3)
crv_cp_3 = CurveClosestPoint(Point=pt_15, Curve=offset_4)  # -> Point, Parameter, Distance
crv_cp_4 = CurveClosestPoint(Point=pt_15, Curve=offset_3)  # -> Point, Parameter, Distance
end = EndPoints(Curve=meshref.direction_2)  # -> Start, End
pt_17 = Point(crv_cp_3.Point)
shift = ShiftList(List=crv_cp_4.Point, Shift=1, Wrap=True)
addition_4 = Addition(A=crv_cp_4.Point, B=shift)
writecurve = Writecurve(starts=end.Start, ends=end.End)  # -> out, a; inputs starts: list of Point3d, ends: list of Point3d
# ---------- writecurve: Python ----------
__author__ = "DELL"
__version__ = "2022.07.08"

import rhinoscriptsyntax as rs
import Rhino
import os

path =Rhino.RhinoDoc.ActiveDoc.Path
dirpath = os.path.dirname(path)

count = len(starts)
print(path)
exfile = open(dirpath + '\curve.txt', 'w')

for i in range(count): 
   startinfo = str(starts[i].X) + "," + str(starts[i].Y) + " "
   endinfo = str(ends[i].X) + "," + str(ends[i].Y) + "\n"
   exfile.write(startinfo)
   exfile.write(endinfo)
   
exfile.close()
# ---------- end writecurve ----------
shift_2 = ShiftList(List=pt_17, Shift=1, Wrap=True)
ln = Line(StartPoint=pt_17, EndPoint=shift_2)
division_5 = Division(A=addition_4, B=2)
pt_18 = Point(division_5)
shift_3 = ShiftList(List=pt_18, Shift=1, Wrap=True)
ln_2 = Line(StartPoint=pt_18, EndPoint=shift_3)
line = Line(meshref.direction_2)
scale_nu_2 = ScaleNU(Geometry=meshref.direction_2, Plane=pcen.CenterV, ScaleX=1, ScaleY=division_2, ScaleZ=1)  # -> Geometry, Transform
pt_19 = Point(dcon.Set)
pt_20 = Point(pt_12)
pline_5 = PolyLine(Vertices=pt_20, Closed=False)
merge_15 = Merge(Data1=pt_17, Data2=pt_16)  # -> flatten(Result)
ln_3 = Line(StartPoint=pt_18, EndPoint=shift_2)
ln_4 = Line(StartPoint=pt_18, EndPoint=pt_17)
lng_5 = ListLength(List=pt_20)
line_2 = Line(scale_nu_2.Geometry)
shift_4 = ShiftList(List=pt_15, Shift=1, Wrap=True)
merge_16 = Merge(Data1=division_5, Data2=crv_cp_3.Point)  # -> flatten(Result)
merge_17 = Merge(Data1=pt_19, Data2=pt_20)  # -> flatten(Result)
crv_17 = Curve(offset)
ln_5 = Line(StartPoint=pt_18, EndPoint=pt_15)
ln_6 = Line(StartPoint=pt_18, EndPoint=shift_4)
cluster_7 = Cluster_8(P=merge_15, C_2=offset_4, C=crv_15)
merge_18 = Merge(Data1=ln_3, Data2=ln_4)
dcon_2 = DeleteConsecutive(Set=merge_16, Wrap=False)  # -> Set, Count
pt_21 = Point(merge_17)
merge_19 = Merge(Data1=ln_5, Data2=ln_6)
merge_20 = Merge(Data1=pt_21, Data2=dcon_2.Set)  # -> flatten(Result)
pt_22 = Point(dcon_2.Set)
cir_2 = Circle(Plane=dcon_2.Set, Radius=ghpython_script_15.innerRadius)
lng_6 = ListLength(List=pt_21)
python_10 = GhPythonScript(horizontal=ghpython_script_15.hspace, vertical=division_4)  # -> out, hypotenuse
# ---------- python_10: Python ----------
__author__ = "DELL"
__version__ = "2022.07.18"

import rhinoscriptsyntax as rs
import math

hypotenuse = math.sqrt(vertical * vertical + (horizontal/2) * (horizontal/2))
# ---------- end python_10 ----------
python_11 = GhPythonScript(horizontal=ghpython_script_15.hspace, vertical=item_2)  # -> out, hypotenuse; same code as python_10
line_3 = Line(ln)
line_4 = Line(merge_18)
line_5 = Line(ln_2)
crv_18 = Curve(crv_17)
line_6 = Line(cluster_7)
line_7 = Line(merge_19)
crv_19 = Curve(cluster_6)
pt_23 = Point(merge_20)
cluster_8 = Cluster_9(C=line_5)
cluster_9 = Cluster_9(C=line_3)
srf_5 = Surface(crv_19)
sdivide = DivideSurface(Surface=srf_5, UCount=100, VCount=100)  # -> flatten(Points), Normals, Parameters
length_line = LengthLine(Line=line_7, Length=python_11.hypotenuse, Strength=0.002)
length_line_2 = LengthLine(Line=cluster_8, Length=ghpython_script_15.hspace, Strength=0.002)
length_line_3 = LengthLine(Line=cluster_9, Length=ghpython_script_15.hspace, Strength=0.002)
length_line_4 = LengthLine(Line=line_4, Length=python_10.hypotenuse, Strength=0.002)
length_line_5 = LengthLine(Line=line_6, Length=division_3, Strength=0.002)
cpc = CurvePointCollide(Points=dcon_2.Set, Curve=crv_18, Plane=PlaneXY(0, 0, 0), Interior=Toggle(False), Strength=0.2)
anchor = Anchor(Point=flatten(pt_21), Strength=10)
anchorxyz = AnchorXYZ(Point=merge_20, X=False, Y=False, Z=bool, Strength=1000)
cpc_2 = CurvePointCollide(Points=dcon_2.Set, Curve=crv_19, Plane=PlaneXY(0, 0, 0), Interior=Toggle(True), Strength=10)
pt_24 = Point(sdivide.Points)
merge_21 = Merge(Data1=pt_14, Data2=pt_22)  # -> flatten(Result)
pline_6 = PolyLine(Vertices=pt_16, Closed=False)
crv_20 = Curve(crv_14)
crv_21 = Curve(pline_5)
mesh_2 = Mesh(crv_20)
cir_3 = Circle(Plane=pt_24, Radius=1)
clscrv_2 = CloseCurve(Curve=crv_21, CloseType=0, Bulge=0.5, Tolerance=0)  # -> Closed, R
srf_6 = Surface(pline_6)
srf_7 = Surface(clscrv_2.Closed)
imgcircles = ImageCircles(Points=pt_14, Mesh=mesh_2, Min=1.2, Max=1.2, Curves=crv_20, Strength=0.0001)
crv_22 = Curve(srf_6)
crv_23 = Curve(srf_7)
entwine = Entwine(
    Branch00=length_line,
    Branch01=length_line_2,
    Branch02=length_line_4,
    Branch03=length_line_3,
    Branch04=length_line_5,
    Branch05=anchor,
    Branch06=anchorxyz,
    Branch07=cpc_2,
    Branch08=cpc,
    FlattenInputs=True)
merge_22 = Merge(Data1=crv_23, Data2=crv_22)  # -> flatten(Result)
solver = Solver(GoalObjects=imgcircles, Reset=Button(), Threshold=1e-15, Tolerance=0.0001, On=Toggle(False))  # -> I, V, O
boundary = BoundarySurfaces(Edges=merge_22)
mesh_3 = Mesh(boundary)
del = DelaunayMesh(Points=solver.V, Plane=PlaneXY(0, 0, 0))
circle = CircleCNR(Center=solver.V, Normal=Vector(0, 0, 1), Radius=solver.O)
cir_4 = Circle(Plane=solver.V, Radius=1)
medges_2 = MeshEdges(Mesh=del)  # -> NakedEdges, InteriorEdges, NonManifoldEdges
stepsolver = StepSolver(GoalObjects=entwine, Tolerance=1e-15, Momentum=True, Damping=0.99, SubIterations=item, Animate=True)  # -> I, V, O
cp_3 = ClosestPoint(Point=pt_21, Cloud=stepsolver.V)  # -> ClosestPoint, CPIndex, Distance
pt_25 = Point(stepsolver.V)
cull_i = CullIndex(List=stepsolver.V, Indices=cp_3.CPIndex, Wrap=True)
incurve = PointInCurve(Point=stepsolver.V, Curve=crv_18)  # -> Relationship, Point
incurve_2 = PointInCurve(Point=stepsolver.V, Curve=crv_19)  # -> Relationship, Point
not = GateNot(A=incurve.Relationship)
pt_26 = Point(cull_i)
cir_5 = Circle(Plane=cull_i, Radius=ghpython_script_15.innerRadius)
curve_4 = Curve(cir_5)
and = GateAnd(A=incurve_2.Relationship, B=not)
dispatch = Dispatch(List=stepsolver.V, DispatchPattern=and)  # -> ListA, ListB
division_6 = Division(A=ghpython_script_15.innerRadius, B=5)
panel_13 = Panel(ghpython_script_20.okay)
pt_27 = Point(dispatch.ListA)
ghpython_script_25 = GhPythonScript(
    holeWindowKey="holeAreaWindowState",
    mainWindowKey="mainWindowState",
    circles=curve_4,
    iter_rounds=panel_5,
    cur_iter=iter,
    okay=ghpython_script_20.okay)  # -> out
# ---------- ghpython_script_25: Python ----------
__author__ = "Administrator"
__version__ = "2022.07.06"


import rhinoscriptsyntax as rs
import scriptcontext as sc
import Rhino
import ghpythonlib.components as ghcomp
import Rhino.Geometry as rg
import Rhino.DocObjects as rd

if okay and int(iter_rounds) == int(cur_iter)+1:
    # bake点到3dm文件中
    try:
        if sc.sticky[mainWindowKey]["isHole"]:
            area_type = "hole"
            area_idx = sc.sticky[holeWindowKey]["holeAreaIndex"]
        else:
            raise NotImplementedError("not implemented!")
            
        surfaceName = "surface-{}-{}".format(area_type, area_idx)    
        print(surfaceName)
        toDeleteList = []
        for obj in sc.doc.Objects:
            if obj.Name is not None:
                if obj.Name == surfaceName:
                    toDeleteList.append(obj)
            
        for obj in toDeleteList:
            sc.doc.Objects.Delete(obj)
        
        print(type(circles)) #debug message to Python output
        #we obtain the reference in the Rhino doc
        doc_object = sc.doc.Objects.Find(circles)
        print(type(doc_object))
     
        attributes = doc_object.Attributes
        print('the type of attributes is: ' + str(type(attributes)))     #debug message to Python output
     
        geometry = doc_object.Geometry
        print('the type of geometry is: ' + str(type(doc_object)))     #debug message to Python output
     
        #we change the scriptcontext
        sc.doc = Rhino.RhinoDoc.ActiveDoc
     
        #we add both the geometry and the attributes to the Rhino doc
        rhino_brep = sc.doc.Objects.Add(geometry, attributes)
        print('the Rhino doc ID is: ' + str(rhino_brep))     #debug message to Python output
        out = True
            
    except Exception as e:
        out = False
        sc.doc = ghdoc
        raise e
    sc.doc = ghdoc
    print("error here")
    out = False
else:
    print("else here")
    print(okay)
    print(cur_iter, iter_rounds, iter_rounds==cur_iter)
    out = False
# ---------- end ghpython_script_25 ----------
subtraction_4 = Subtraction(A=dispatch.ListA, B=dcon_2.Set)
panel_14 = Panel(ghpython_script_25)
vlen = VectorLength(Vector=subtraction_4)
vec = Vector(subtraction_4)
panel_15 = Panel(curve_4)
line_8 = LineSDL(Start=dcon_2.Set, Direction=subtraction_4, Length=vlen)
line_9 = Line(line_8)

create_list_box = CreateListBox(ListItems=ghpython_script_14.editList, SelectedIndex=0, Height=100)
value_listener_18 = ValueListener(Elements=create_list_box, SomeProperty=True)  # -> Values, Indices
ghpython_script_26 = GhPythonScript(index=value_listener_18.Values, key="mainWindowState")  # -> out, a
# ---------- ghpython_script_26: Python ----------
__author__ = "USER"
__version__ = "2022.05.22"

import rhinoscriptsyntax as rs
import scriptcontext as sc

if index is not None:
    if not sc.sticky.has_key(key):
        sc.sticky[key] = {}
    sc.sticky[key]["holeAreaIndexCandidate"] = index[4:]
    if index.startswith("孔"):
        sc.sticky[key]["editHole"] = True
        sc.sticky[key]["editBand"] = False
    else:
        sc.sticky[key]["editHole"] = False
        sc.sticky[key]["editBand"] = True
# ---------- end ghpython_script_26 ----------
create_scroll_viewer = CreateScrollViewer(
    UIElements=create_list_box,
    HorizontalScrollBarVisibility=0,
    VerticalScrollBarVisibility=boolean_3,
    Height=Slider(150, range=0..1000))

merge_23 = Merge(Data1=create_label, Data2=create_scroll_viewer, Data3=create_stack)

create_stack_9 = CreateStack(UIElements=merge_23, Horizontal=boolean_5)
create_border_4 = CreateBorder(UIElement=create_stack_9, BorderThickness=Slider(0, range=0..100), BorderColor=RGB(0, 0, 0), CornerRadius=0)
merge_24 = Merge(Data1=create_label_4, Data2=create_border, Data3=create_label_3, Data4=create_border_4, Data5=create_image)
add_elements_2 = AddElements(Window=launch_window, Elements=flatten(merge_24), DoVLChecking=True)  # -> AddedElements, ElementNames

# ==== cluster Cluster
referedge = ClusterInput()
radius = ClusterInput()
vspace = ClusterInput()
hspace = ClusterInput()
panel = Panel(vspace)
panel_2 = Panel(radius)
num = Number(radius)
num_2 = Number(hspace)
crv = Curve(referedge)
num_3 = Number(vspace)
python = GhPythonScript(crv=crv, radius=num, vspace=num_3, hspace=num_2)  # -> out, row_confs; inputs crv: Curve, radius: list, vspace: list, hspace: list
# ---------- python: Python ----------
__author__ = "wangxu"
__version__ = "2022.05.06"

import rhinoscriptsyntax as rs
import ghpythonlib.components as ghcomp

def safe_list_access(arr, i):
    arr_len = len(arr)
    if i < 0:
        return 0
    elif i < arr_len:
        return arr[i]
    else:
        return arr[arr_len - 1]

crv_length = crv.GetLength()
print(crv_length)
i = 0
total_offset = 0.0

row_confs = []

n = len(radius)
while True:
    cr = safe_list_access(radius, i)
    cv = safe_list_access(vspace, i - 1)
    print(cv)
    offset = cv
    if cv == 0:
        offset = cr
    total_offset += offset
    item = ghcomp.Dhictionary.CreateDictionary(['offset', 'radius', 'vspace', 'hspace'], [total_offset, cr, cv, hspace[0]])
    row_confs.append(item)
  
    if ((total_offset >= crv_length) or (i == n - 1)):
        break
    else:
        i += 1
print(row_confs)
# ---------- end python ----------
D = Dict(python.row_confs)
row_conf = ClusterOutput(D)

# ==== cluster Cluster_2
rowconf = ClusterInput()
crv = ClusterInput()  # 内环曲线
dictselect = DictSelect(Dict=rowconf, Key="hspace")  # -> Key, Value, Found
dictselect_2 = DictSelect(Dict=rowconf, Key="radius")  # -> Key, Value, Found
dictselect_3 = DictSelect(Dict=rowconf, Key="offset")  # -> Key, Value, Found

# ---- group: 内环1 / 参数
crv_2 = Curve(crv)
num = Number(dictselect.Value)
num_2 = Number(dictselect_2.Value)

# ----
offset = OffsetCurve(Curve=crv_2, Distance=dictselect_3.Value, Corners=1)

# ---- group: 内环1
len = Length(Curve=crv_2)
division = Division(A=len, B=num)
round = Round(Number=division)  # -> Nearest, Floor, Ceiling
divide = DivideCurve(Curve=offset, Count=round.Floor, Kinks=False)  # -> Points, Tangents, Parameters

# ----
offset_2 = OffsetCurve(Curve=offset, Distance=dictselect_2.Value, Corners=1)
crv_cp = CurveClosestPoint(Point=divide.Points, Curve=crv_2)  # -> Point, Parameter, Distance

# ---- group: 内环1 / 输出
pt = Point(divide.Points)
vec = Vector(divide.Tangents)

# ----
eval = EvaluateCurve(Curve=crv_2, Parameter=crv_cp.Parameter)  # -> Point, Tangent, Angle
bottom_border = ClusterOutput(offset_2)
refer_vec = ClusterOutput(eval.Tangent)
refer_pts = ClusterOutput(crv_cp.Point)
radius = ClusterOutput(num_2)
pts = ClusterOutput(pt)  # 圆点坐标
vec_2 = ClusterOutput(vec)  # 切线方向

# ==== cluster Display
radius = ClusterInput()
pts = ClusterInput()
cir = Circle(Plane=pts, Radius=radius)
srf = Surface(cir)
srf_2 = ClusterOutput(srf)

# ==== cluster Cluster_3
refer_dis = ClusterInput()
D = ClusterInput()
refer_pts = ClusterInput()
refer_vec = ClusterInput()
crv = ClusterInput()
crv_2 = Curve(crv)
pt = Point(refer_pts)
crv_cp = CurveClosestPoint(Point=refer_pts, Curve=crv)  # -> Point, Parameter, Distance
multiplication = Multiplication(A=refer_dis, B=1.1)
eval = EvaluateCurve(Curve=crv, Parameter=crv_cp.Parameter)  # -> Point, Tangent, Angle
multiplication_2 = Multiplication(A=refer_vec, B=eval.Tangent)
abs = Absolute(Value=multiplication_2)
D_2 = Dict(D)
acos = ArcCosine(Value=abs)
pi = Pi(Factor=1)
division = Division(A=acos, B=pi)
multiplication_3 = Multiplication(A=division, B=180)
dictselect = DictSelect(Dict=D_2, Key="hspace")  # -> Key, Value, Found
smaller = SmallerThan(FirstNumber=multiplication_3, SecondNumber=10)  # -> SmallerThan, OrEqualTo
smaller_2 = SmallerThan(FirstNumber=crv_cp.Distance, SecondNumber=multiplication)  # -> SmallerThan, OrEqualTo
num = Number(crv_cp.Parameter)
and = GateAnd(A=smaller.SmallerThan, B=smaller_2.SmallerThan)
shift = ShiftList(List=crv_cp.Point, Shift=1, Wrap=True)
shift_2 = ShiftList(List=and, Shift=1, Wrap=True)
xor = GateXor(A=and, B=shift_2)
bool = Boolean(True)
mindex = MemberIndex(Set=xor, Member=bool)  # -> Index, Count
item = ListItem(List=shift, Index=mindex.Index, Wrap=True)
item_2 = ListItem(List=item, Index=0, Wrap=True)
crv_cp_2 = CurveClosestPoint(Point=item_2, Curve=crv)  # -> Point, Parameter, Distance
item_3 = ListItem(List=num, Index=mindex.Index, Wrap=True)
item_4 = ListItem(List=mindex.Index, Index=1, Wrap=True)
item_5 = ListItem(List=mindex.Index, Index=0, Wrap=True)
item_6 = ListItem(List=item_3, Index=1, Wrap=True)
dom = ConstructDomain(DomainStart=item_5, DomainEnd=item_4)
subtraction = Subtraction(A=item_4, B=item_5)
pt_2 = Point(crv_cp.Point)
item_7 = ListItem(List=mindex.Index, Index=0, Wrap=True)
merge = Merge(Data1=crv_cp_2.Parameter, Data2=item_6)
range = Range(Domain=dom, Steps=subtraction)
bool_2 = Boolean(False)
bnd = Bounds(Numbers=merge)
cull_i = CullIndex(List=range, Indices=0, Wrap=True)
replace = ReplaceItems(List=and, Item=bool_2, Indices=cull_i, Wrap=False)
subcrv = SubCurve(BaseCurve=crv, Domain=bnd)
crv_3 = Curve(subcrv)
len = Length(Curve=subcrv)
division_2 = Division(A=len, B=dictselect.Value)
top_subcrv = ClusterOutput(subcrv)
round = Round(Number=division_2)  # -> Nearest, Floor, Ceiling
divide = DivideCurve(Curve=subcrv, Count=round.Floor, Kinks=False)  # -> Points, Tangents, Parameters
pt_3 = Point(divide.Points)
lng = ListLength(List=pt_3)
subtraction_2 = Subtraction(A=lng, B=1)
cull_i_2 = CullIndex(List=pt_3, Indices=subtraction_2, Wrap=True)
pt_4 = Point(cull_i_2)
dispatch = Dispatch(List=pt_2, DispatchPattern=replace)  # -> ListA, ListB
lng_2 = ListLength(List=pt_3)
panel = Panel(pt_3)
python = GhPythonScript(start=item_5, count=lng_2)  # -> out, index_list, after_list; inputs start: Int32
# ---------- python: Python ----------
__author__ = "zhengyawen"
__version__ = "2022.05.07"

import rhinoscriptsyntax as rs
import ghpythonlib.components as ghcomp

index_list = []
after_list = []
i = 0

while(i<count):
    index_list.append(start+1)
    after_list.append(start+i+1)
    i += 1
# ---------- end python ----------
pt_5 = Point(dispatch.ListA)
pt_6 = Point(dispatch.ListB)
ins = InsertItems(List=dispatch.ListA, Item=pt_3, Indices=python.index_list, Wrap=True)
pt_7 = Point(ins)
rev = ReverseList(List=pt_7)
refer_pts_2 = ClusterOutput(pt_7)
panel_2 = Panel(pt_7)
panel_3 = Panel(rev)

# ==== cluster Cluster_4
D = ClusterInput()
top_subcrv = ClusterInput()
refer_dis = ClusterInput()
dictselect = DictSelect(Dict=D, Key="offset")  # -> Key, Value, Found
crv = ClusterInput()
refer_pts = ClusterInput()
dictselect_2 = DictSelect(Dict=D, Key="radius")  # -> Key, Value, Found
subtraction = Subtraction(A=dictselect.Value, B=refer_dis)
xy = XYPlane(Origin=Point(0, 0, 0))
offset = OffsetCurve(Curve=top_subcrv, Distance=subtraction, Corners=1)
offset_2 = OffsetCurve(Curve=crv, Distance=subtraction, Plane=xy, Corners=1)
num = Number(dictselect_2.Value)
xy_2 = XYPlane(Origin=Point(0, 0, 0))
crv_cp = CurveClosestPoint(Point=refer_pts, Curve=offset_2)  # -> Point, Parameter, Distance
crv_2 = Curve(offset)
offset_3 = OffsetCurve(Curve=offset, Distance=num, Plane=xy_2, Corners=1)
pt = Point(crv_cp.Point)
top_border = ClusterOutput(offset_3)
crv_3 = Curve(offset_3)
pts = ClusterOutput(pt)
offset_curve = ClusterOutput(offset_2)
radius = ClusterOutput(num)

# ==== cluster MeshRef: create input variables for instant meshes exe
surround = ClusterInput()
vertical = ClusterInput()
horizontal = ClusterInput()
crv = ClusterInput()

surround_2 = Number(surround)
crv_2 = Curve(crv)
horizontal_2 = Number(horizontal)
vertical_2 = Number(vertical)

addition = Addition(A=horizontal_2, B=vertical_2)
division = Division(A=addition, B=5)
multiplication = Multiplication(A=horizontal_2, B=vertical_2)
disc = Discontinuity(Curve=crv_2, Level=1)  # -> Points, Parameters
offset = OffsetCurve(Curve=crv_2, Distance=division, Plane=PlaneXY(0, 0, 0), Corners=1)
pdecon = Deconstruct(Point=disc.Points)  # -> XComponent, YComponent, ZComponent
len = Length(Curve=crv_2)
division_2 = Division(A=len, B=surround_2)
area = Area(Geometry=crv_2)  # -> Area, Centroid
division_3 = Division(A=area.Area, B=multiplication)
srf = Surface(offset)
round = Round(Number=division_2)  # -> Nearest, Floor, Ceiling
divide = DivideCurve(Curve=crv_2, Count=round.Nearest, Kinks=False)  # -> Points, Tangents, Parameters
merge = Merge(Data1=disc.Points, Data2=divide.Points)
divide_2 = DivideCurve(Curve=crv_2, Count=round.Nearest, Kinks=False)  # -> Points, Tangents, Parameters
pdecon_2 = Deconstruct(Point=merge)  # -> XComponent, YComponent, ZComponent
bnd = Bounds(Numbers=pdecon.XComponent)
dedomain = DeconstructDomain(Domain=bnd)  # -> Start, End
larger = LargerThan(FirstNumber=pdecon.XComponent, SecondNumber=dedomain.Start)  # -> LargerThan, OrEqualTo
dispatch = Dispatch(List=disc.Points, DispatchPattern=larger.LargerThan)  # -> ListA, ListB
pdecon_3 = Deconstruct(Point=divide_2.Points)  # -> XComponent, YComponent, ZComponent
pt = Point(divide_2.Points)
lng = ListLength(List=divide.Points)
pt_2 = Point(divide.Points)
bnd_2 = Bounds(Numbers=pdecon_2.XComponent)
dedomain_2 = DeconstructDomain(Domain=bnd_2)  # -> Start, End
bnd_3 = Bounds(Numbers=pdecon_2.YComponent)
dedomain_3 = DeconstructDomain(Domain=bnd_3)  # -> Start, End
bnd_4 = Bounds(Numbers=pdecon_3.XComponent)
dedomain_4 = DeconstructDomain(Domain=bnd_4)  # -> Start, End
subtraction = Subtraction(A=dedomain_4.End, B=dedomain_4.Start)
bnd_5 = Bounds(Numbers=pdecon_3.YComponent)
dedomain_5 = DeconstructDomain(Domain=bnd_5)  # -> Start, End
subtraction_2 = Subtraction(A=dedomain_5.End, B=dedomain_5.Start)
pt_3 = ConstructPoint(XCoordinate=dedomain_2.Start, YCoordinate=dedomain_3.End, ZCoordinate=0)
division_4 = Division(A=lng, B=3)
division_5 = Division(A=subtraction, B=horizontal_2)
division_6 = Division(A=subtraction_2, B=vertical_2)
pt_4 = Point(pt_3)
round_2 = Round(Number=division_6)  # -> Nearest, Floor, Ceiling
round_3 = Round(Number=division_5)  # -> Nearest, Floor, Ceiling
addition_2 = Addition(A=round_2.Nearest, B=1)
round_4 = Round(Number=division_4)  # -> Nearest, Floor, Ceiling
addition_3 = Addition(A=round_3.Nearest, B=1)
pdecon_4 = Deconstruct(Point=pt_3)  # -> XComponent, YComponent, ZComponent
dom = ConstructDomain(DomainStart=0, DomainEnd=round_3.Nearest)
dom_2 = ConstructDomain(DomainStart=0, DomainEnd=round_2.Nearest)
multiplication_2 = Multiplication(A=addition_2, B=addition_3)
range = Range(Domain=dom, Steps=round_3.Nearest)
range_2 = Range(Domain=dom_2, Steps=round_2.Nearest)
lng_2 = ListLength(List=range_2)
repeat = RepeatData(Data=range, Length=multiplication_2)
repeat_2 = RepeatData(Data=range_2, Length=multiplication_2)
multiplication_3 = Multiplication(A=range_2, B=vertical_2)
multiplication_4 = Multiplication(A=lng_2, B=2)
multiplication_5 = Multiplication(A=repeat, B=horizontal_2)
matrix = ConstructMatrix(Rows=addition_2, Columns=addition_3, Values=multiplication_5)
transpose = TransposeMatrix(Matrix=matrix)
dematrix = DeconstructMatrix(Matrix=transpose)  # -> Rows, Columns, Values
multiplication_6 = Multiplication(A=repeat_2, B=vertical_2)
repeat_3 = RepeatData(Data=multiplication_3, Length=multiplication_4)
addition_4 = Addition(A=pdecon_4.XComponent, B=dematrix.Values)
subtraction_3 = Subtraction(A=pdecon_4.YComponent, B=multiplication_6)
merge_2 = Merge(Data1=dedomain_4.Start, Data2=dedomain_4.End)
matrix_2 = ConstructMatrix(Rows=2, Columns=lng_2, Values=repeat_3)
pt_5 = ConstructPoint(XCoordinate=addition_4, YCoordinate=subtraction_3, ZCoordinate=0)
repeat_4 = RepeatData(Data=merge_2, Length=multiplication_4)
transpose_2 = TransposeMatrix(Matrix=matrix_2)
pt_6 = Point(pt_5)
incurve = PointInCurve(Point=pt_6, Curve=crv_2)  # -> Relationship, Point
dematrix_2 = DeconstructMatrix(Matrix=transpose_2)  # -> Rows, Columns, Values
subtraction_4 = Subtraction(A=pdecon_4.YComponent, B=dematrix_2.Values)
dispatch_2 = Dispatch(List=pt_6, DispatchPattern=incurve.Relationship)  # -> ListA, ListB
lng_3 = ListLength(List=dispatch_2.ListA)
pt_7 = ConstructPoint(XCoordinate=repeat_4, YCoordinate=subtraction_4, ZCoordinate=0)
pt_8 = Point(dispatch_2.ListA)
addition_5 = Addition(A=lng_3, B=0)
dispatch_3 = Dispatch(List=pt_7, DispatchPattern=[True, False])  # -> ListA, ListB
pt_9 = Point(pt_7)
sort_pt = SortPoints(Points=dispatch_3.ListB)  # -> Points, Indices
sort_pt_2 = SortPoints(Points=dispatch_3.ListA)  # -> Points, Indices
pt_10 = Point(dispatch_3.ListB)
pt_11 = Point(dispatch_3.ListA)
graft = GraftTree(Tree=sort_pt.Points, IncludeEmptyLists=True, IncludeNullItems=True)
graft_2 = GraftTree(Tree=sort_pt_2.Points, IncludeEmptyLists=True, IncludeNullItems=True)
srf_2 = Surface(crv_2)
merge_3 = Merge(Data1=graft_2, Data2=graft)
tri = Triangulate(Mesh=srf_2)  # -> Mesh, Count
pline = PolyLine(Vertices=merge_3, Closed=False)  # -> flatten(Polyline)
medges = MeshEdges(Mesh=tri.Mesh)  # -> NakedEdges, InteriorEdges, NonManifoldEdges
line = Line(pline)
trim = TrimWithRegion(Curve=line, Region=srf)  # -> flatten(Inside), Outside

direction = Line(trim.Inside)
mesh = Mesh(tri.Mesh)
vernum = Number(addition_5)
upleftbasept = Point(dispatch.ListB)

direction_2 = ClusterOutput(direction)
upleftbasept_2 = ClusterOutput(upleftbasept)
vernum_2 = ClusterOutput(vernum)
mesh_2 = ClusterOutput(mesh)

# ==== cluster Shifthalf
crv = ClusterInput()
P = ClusterInput()
crv_cp = CurveClosestPoint(Point=P, Curve=crv)  # -> Point, Parameter, Distance
shift = ShiftList(List=crv_cp.Parameter, Shift=1, Wrap=True)
addition = Addition(A=shift, B=crv_cp.Parameter)
division = Division(A=addition, B=2)
lng = ListLength(List=division)
num = Number(1)
subtraction = Subtraction(A=lng, B=num)
split = SplitList(List=division, Index=subtraction)  # -> ListA, ListB
eval = EvaluateCurve(Curve=crv, Parameter=split.ListA)  # -> Point, Tangent, Angle
P_2 = ClusterOutput(eval.Point)

# ==== cluster Cluster_6
crv1 = ClusterInput()
t1 = ClusterInput()
crv2 = ClusterInput()
t2 = ClusterInput()
item = ListItem(List=t1, Index=0, Wrap=True)
item_2 = ListItem(List=t2, Index=0, Wrap=True)
item_3 = ListItem(List=t1, Index=1, Wrap=True)
item_4 = ListItem(List=t2, Index=1, Wrap=True)
cluster = Cluster_5(C=crv1, B_2=item, B=item_3)
ccx = CurveCurve(CurveA=crv1, CurveB=crv2)  # -> Points, ParamsA, ParamsB
cluster_2 = Cluster_5(C=crv2, B_2=item_2, B=item_4)
pt = Point(ccx.Points)
rulesrf = RuledSurface(CurveA=cluster, CurveB=cluster_2)
S = ClusterOutput(rulesrf)

# ==== cluster Cluster_7
innercrv = ClusterInput()
outercrv = ClusterInput()
end = EndPoints(Curve=innercrv)  # -> Start, End
flip = FlipCurve(Curve=innercrv)  # -> Curve, Flag
flip_2 = FlipCurve(Curve=outercrv)  # -> Curve, Flag
clscrv = CloseCurve(Curve=outercrv, CloseType=0, Bulge=0.5, Tolerance=0)  # -> Closed, R
merge = Merge(Data1=innercrv, Data2=flip.Curve)
xy = XYPlane(Origin=Point(0, 0, 0))
offset = OffsetCurve(Curve=clscrv.Closed, Distance=1, Plane=xy, Corners=1)
pi = Pi(Factor=1)
division = Division(A=pi, B=2)
area = Area(Geometry=clscrv.Closed)  # -> Area, Centroid
area_2 = Area(Geometry=offset)  # -> Area, Centroid
merge_2 = Merge(Data1=outercrv, Data2=flip_2.Curve)
smaller = SmallerThan(FirstNumber=area_2.Area, SecondNumber=area.Area)  # -> SmallerThan, OrEqualTo
not = GateNot(A=smaller.SmallerThan)
clscrv_2 = CloseCurve(Curve=innercrv, CloseType=0, Bulge=0.5, Tolerance=0)  # -> Closed, R
not_2 = GateNot(A=clscrv_2.R)
merge_3 = Merge(Data1=not, Data2=smaller.SmallerThan)
merge_4 = Merge(Data1=clscrv_2.R, Data2=not_2)
dispatch = Dispatch(List=merge_2, DispatchPattern=merge_3)  # -> ListA, ListB
xy_2 = XYPlane(Origin=Point(0, 0, 0))
end_2 = EndPoints(Curve=dispatch.ListB)  # -> Start, End
seam2crvcorn = SeamToCurveCorner(Curve=innercrv, Guide=end_2.Start)  # -> Adjusted, Point, R
flip_3 = FlipCurve(Curve=seam2crvcorn.Adjusted)  # -> Curve, Flag
end_3 = EndPoints(Curve=seam2crvcorn.Adjusted)  # -> Start, End
crv = Curve(seam2crvcorn.Adjusted)
dist = Distance(PointA=end_2.Start, PointB=end.End)
dist_2 = Distance(PointA=end_2.Start, PointB=end.Start)
crv_cp = CurveClosestPoint(Point=end_3.Start, Curve=innercrv)  # -> Point, Parameter, Distance
pt = Point(end_3.Start)
eval = EvaluateCurve(Curve=innercrv, Parameter=crv_cp.Parameter)  # -> Point, Tangent, Angle
smaller_2 = SmallerThan(FirstNumber=dist_2, SecondNumber=dist)  # -> SmallerThan, OrEqualTo
merge_5 = Merge(Data1=flip_3.Curve, Data2=seam2crvcorn.Adjusted)
not_3 = GateNot(A=smaller_2.SmallerThan)
crv_cp_2 = CurveClosestPoint(Point=end_2.Start, Curve=dispatch.ListB)  # -> Point, Parameter, Distance
merge_6 = Merge(Data1=smaller_2.SmallerThan, Data2=not_3)
eval_2 = EvaluateCurve(Curve=dispatch.ListB, Parameter=crv_cp_2.Parameter)  # -> Point, Tangent, Angle
angle = Angle(VectorA=eval_2.Tangent, VectorB=eval.Tangent)  # -> Angle, Reflex
larger = LargerThan(FirstNumber=angle.Angle, SecondNumber=division)  # -> LargerThan, OrEqualTo
not_4 = GateNot(A=larger.LargerThan)
merge_7 = Merge(Data1=larger.LargerThan, Data2=not_4)
dispatch_2 = Dispatch(List=merge_5, DispatchPattern=merge_7)  # -> ListA, ListB
dispatch_3 = Dispatch(List=merge, DispatchPattern=merge_6)  # -> ListA, ListB
merge_8 = Merge(Data1=dispatch_3.ListA, Data2=dispatch_2.ListA)
end_4 = EndPoints(Curve=dispatch_3.ListA)  # -> Start, End
pt_2 = Point(end_4.Start)
dispatch_4 = Dispatch(List=merge_8, DispatchPattern=merge_4)  # -> ListA, ListB
offset_2 = OffsetCurve(Curve=dispatch.ListB, Distance=1, Plane=xy_2, Corners=1)
pt_3 = Point(end_2.Start)
end_5 = EndPoints(Curve=dispatch_4.ListA)  # -> Start, End
crv_2 = Curve(offset_2)
innercrv_2 = ClusterOutput(dispatch_4.ListA)
outercrv_2 = ClusterOutput(dispatch.ListB)
pt_4 = Point(end_5.Start)
crv_cp_3 = CurveClosestPoint(Point=end_5.Start, Curve=dispatch_4.ListA)  # -> Point, Parameter, Distance
xy_3 = XYPlane(Origin=Point(0, 0, 0))
eval_3 = EvaluateCurve(Curve=dispatch_4.ListA, Parameter=crv_cp_3.Parameter)  # -> Point, Tangent, Angle
offset_3 = OffsetCurve(Curve=dispatch_4.ListA, Distance=1, Plane=xy_3, Corners=1)
crv_3 = Curve(offset_3)

# ==== cluster PointAlongCurve
P = ClusterInput()
C = ClusterInput()
A = ClusterInput()
rev = ReverseList(List=P)
crv_cp = CurveClosestPoint(Point=P, Curve=C)  # -> Point, Parameter, Distance
pt = Point(P)
division = Division(A=A, B=2)
bnd = Bounds(Numbers=crv_cp.Distance)
dedomain = DeconstructDomain(Domain=bnd)  # -> Start, End
panel = Panel(rev)
num = Number(dedomain.Start)
addition = Addition(A=num, B=division)
smaller = SmallerThan(FirstNumber=crv_cp.Distance, SecondNumber=addition)  # -> SmallerThan, OrEqualTo
dispatch = Dispatch(List=P, DispatchPattern=smaller.SmallerThan)  # -> ListA, ListB
panel_2 = Panel(dispatch.ListA)
pt_2 = Point(dispatch.ListA)
A_2 = ClusterOutput(dispatch.ListA)

# ==== cluster Cluster_8
C = ClusterInput()
P = ClusterInput()
crv = Curve(C)
del = DelaunayMesh(Points=P, Plane=PlaneXY(0, 0, 0))
medges = MeshEdges(Mesh=del)  # -> NakedEdges, InteriorEdges, NonManifoldEdges
midpt = CurveMiddle(Curve=medges.InteriorEdges)
incurve = PointInCurve(Point=midpt, Curve=C)  # -> Relationship, Point
end = EndPoints(Curve=medges.InteriorEdges)  # -> Start, End
not = GateNot(A=incurve.Relationship)
midpt_2 = CurveMiddle(Curve=medges.InteriorEdges)
crv_2 = Curve(medges.InteriorEdges)
C_2 = ClusterInput()
incurve_2 = PointInCurve(Point=end.Start, Curve=C)  # -> Relationship, Point
incurve_3 = PointInCurve(Point=end.End, Curve=C)  # -> Relationship, Point
incurve_4 = PointInCurve(Point=midpt_2, Curve=C_2)  # -> Relationship, Point
not_2 = GateNot(A=incurve_2.Relationship)
crv_3 = Curve(C_2)
not_3 = GateNot(A=incurve_3.Relationship)
and = GateAnd(A=not_2, B=not_3)
or = GateOr(A=and, B=not)
and_2 = GateAnd(A=incurve_4.Relationship, B=or)
dispatch = Dispatch(List=medges.InteriorEdges, DispatchPattern=and_2)  # -> ListA, ListB
crv_4 = Curve(dispatch.ListA)
A = ClusterOutput(dispatch.ListA)

# ==== cluster Cluster_9
C = ClusterInput()
len = Length(Curve=C)
equals = Equality(FirstNumber=len, SecondNumber=0)  # -> Equality, Inequality
dispatch = Dispatch(List=C, DispatchPattern=equals.Equality)  # -> ListA, ListB
B = ClusterOutput(dispatch.ListB)

# ==== cluster Cluster_5
B = ClusterInput()
C = ClusterInput()
crvdom = CurveDomain(Curve=C)  # -> Curve, Domain
dedomain = DeconstructDomain(Domain=crvdom.Domain)  # -> Start, End
crvdom_2 = CurveDomain(Curve=C)  # -> Curve, Domain
addition = Addition(A=dedomain.Start, B=dedomain.End)
division = Division(A=addition, B=2)
smaller = SmallerThan(FirstNumber=division, SecondNumber=B)  # -> SmallerThan, OrEqualTo
not = GateNot(A=smaller.SmallerThan)
merge = Merge(Data1=smaller.SmallerThan, Data2=not)
dedomain_2 = DeconstructDomain(Domain=crvdom_2.Domain)  # -> Start, End
merge_2 = Merge(Data1=B, Data2=dedomain_2.End)  # -> flatten(Result)
B_2 = ClusterInput()
dispatch = Dispatch(List=reverse(merge_2), DispatchPattern=merge)  # -> ListA, ListB
larger = LargerThan(FirstNumber=division, SecondNumber=B_2)  # -> LargerThan, OrEqualTo
not_2 = GateNot(A=larger.LargerThan)
crvdom_3 = CurveDomain(Curve=C)  # -> Curve, Domain
merge_3 = Merge(Data1=larger.LargerThan, Data2=not_2)
dedomain_3 = DeconstructDomain(Domain=crvdom_3.Domain)  # -> Start, End
merge_4 = Merge(Data1=B_2, Data2=dedomain_3.Start)  # -> flatten(Result)
dispatch_2 = Dispatch(List=reverse(merge_4), DispatchPattern=merge_3)  # -> ListA, ListB
dom = ConstructDomain(DomainStart=dispatch_2.ListA, DomainEnd=dispatch.ListA)
subcrv = SubCurve(BaseCurve=crvdom_2.Curve, Domain=dom)
C_2 = ClusterOutput(subcrv)
crv = Curve(subcrv)
